# Dynamo graph Revit Application.dyn (Dynamo 1.3.4.6666)

format = Orchid.Common.Revit.Format()
watch = Watch(format)
version = Orchid.Common.Revit.Version()
watch_2 = Watch(version)
versionBuild = Orchid.Common.Revit.VersionBuild()
watch_3 = Watch(versionBuild)
username = Orchid.Common.Revit.Username()
watch_4 = Watch(username)
