# Dynamo graph Revit Application.dyn (Dynamo 2.0.4.12684)

version = Orchid.Applications.Revit.Version()
watch = Watch(version)
versionBuild = Orchid.Applications.Revit.VersionBuild()
watch_2 = Watch(versionBuild)
format = Orchid.Applications.Revit.Format()
watch_3 = Watch(format)
username = Orchid.Applications.Revit.Username()
watch_4 = Watch(username)
