# Dynamo graph Core-Scripting.dyn (Dynamo 2.3.0.5885)
# packages: Orchid 203.3.0.7798

# group: CSV writer with delimiter
string = StringInput("..\test.csv")  # graph input
string_2 = StringInput("\n")
sort = List.Sort()  # frozen; unwired: list
join = String.Join(separator=string_2, string0=sort)
writeText = FileSystem.WriteText(filePath=string, text=join)
watch = Watch(join)

# group: Python
string_3 = StringInput("..\")  # graph input
string_4 = StringInput("ScriptTest.py")  # graph input
boolean = BoolSelector(false)  # graph input
scriptFileReader = Orchid.Common.Scripting.ScriptFileReader(path=string_3, file=string_4, refresh=boolean)
python_script_from_string = PythonStringNode(script=scriptFileReader)
watch_2 = Watch(python_script_from_string)
watch_3 = Watch(scriptFileReader)

# group: Dynamo Packages and Definitions Path
dynamoPackagesPath = Orchid.Common.Scripting.DynamoPackagesPath()
watch_4 = Watch(dynamoPackagesPath)
dynamoDefinitionsPath = Orchid.Common.Scripting.DynamoDefinitionsPath()
watch_5 = Watch(dynamoDefinitionsPath)
code_block = CodeBlock { Orchid.Common.Scripting.DynamoPackagesPath(); Orchid.Common.Scripting.DynamoDefinitionsPath(); }
watch_6 = Watch(code_block.out0)
watch_7 = Watch(code_block.out1)

# group: Python -> the "old" way
string_5 = StringInput("..\")  # graph input
string_6 = StringInput("ScriptTest.py")  # graph input
contents = Orchid.Common.Directory.Contents(directory=string_5, searchString=string_6)
readText = FileSystem.ReadText(file=contents)
watch_8 = Watch(readText)
python_script_from_string_2 = PythonStringNode(script=readText)
watch_9 = Watch(python_script_from_string_2)

# group: Python
code_block_2 = CodeBlock()
# ---------- code_block_2.designscript (5 lines) ----------
t1 = Orchid.Common.Directory.Current;
t2 = "..\\ScriptTest.py";
t3 = false;

Orchid.Common.Scripting.ScriptFileReader(t1, t2, t3);
# ----------------------------------------
python_script_from_string_3 = PythonStringNode(script=code_block_2.out3)
watch_10 = Watch(python_script_from_string_3)
watch_11 = Watch(code_block_2.out3)

# group: File from path
string_7 = StringInput("%userprofile%\Programming\Source\OrchidForDynamo\Samples\Data\ScriptTest.py")  # graph input
fromPath = Orchid.Common.File.FromPath(path=string_7)
watch_12 = Watch(fromPath)
readText_2 = FileSystem.ReadText(file=fromPath)
watch_13 = Watch(readText_2)

# group: Current directory
current = Orchid.Common.Directory.Current()
watch_14 = Watch(current)

# group: directory from path
string_8 = StringInput("%userprofile%\Programming\Source\OrchidForDynamo\Samples\Data\testSet")  # graph input
fromPath_2 = Orchid.Common.Directory.FromPath(path=string_8)
contents_2 = Orchid.Common.Directory.Contents(directory=fromPath_2)
watch_15 = Watch(contents_2)
watch_16 = Watch(fromPath_2)

# group: Await
code_block_3 = CodeBlock { [1..5,1..5,1..5]; }
code_block_4 = CodeBlock { ["a".."e","a".."e"]; }
await_ = Orchid.Common.DataStream.Await(pass=code_block_3, waitFor=code_block_4)
watch_17 = Watch(await_)

# group: Circut
code_block_5 = CodeBlock { [1..5,1..5,1..5]; }
boolean_2 = BoolSelector(true)  # graph input
circut = Orchid.Common.DataStream.Circut(pass=code_block_5, state=boolean_2)
watch_18 = Watch(circut)

# group: Update the package
update = Orchid.About.Update()
watch_19 = Watch(update)

# group: About the package
orchid = Orchid.About.Orchid()
watch_20 = Watch(orchid)

# group: Filter by Type
code_block_6 = CodeBlock { 2..5..0.5; [2,2.5,3,3.5,4,4.5,5]; }
code_block_7 = CodeBlock { "System.Double"; "System.Int32"; "System.Int64"; }
toType = Orchid.Common.String.ToType(string=code_block_7.out0)
typeOf = Orchid.Common.Object.TypeOf(object=code_block_6.out1, type=toType)
watch_21 = Watch(typeOf)
