# Dynamo graph Culture.dyn (Dynamo 2.6.1.8786)
# packages: Orchid 206.3.0.7978

# group: Culture name, by name, and display name
culture = Culture("da-DK")
byName = Orchid.Common.Culture.ByName(name=culture)
watch = Watch(byName)
displayName = Orchid.Common.Culture.DisplayName(culture=byName)
watch_2 = Watch(displayName)
name = Orchid.Common.Culture.Name(culture=byName)
watch_3 = Watch(name)

today = DateTime.Today()
dayOfWeek = DateTime.DayOfWeek(dateTime=today)
format = DateTime.Format(dateTime=today)

# group: Current culture Current revit culture
current = Orchid.Common.Culture.Current()
culture_2 = Orchid.Common.Revit.Culture()
edit = Orchid.Common.Culture.Edit(culture=culture_2)

# group: All Cultures
all = Orchid.Common.Culture.All()
watch_4 = Watch(all)

# group: Modify calendar, time and date
code_block = CodeBlock { "Tuesday"; }
setCalendar = Orchid.Common.Culture.SetCalendar(culture=edit, firstDay=code_block)
setDateTime = Orchid.Common.Culture.SetDateTime(culture=setCalendar)
setDate = Orchid.Common.Culture.SetDate(culture=setDateTime)
setTime = Orchid.Common.Culture.SetTime(culture=setDate)

# group: Language name and by name
revit_language = Language("English_USA")
byName_2 = Orchid.Common.Language.ByName(name=revit_language)
watch_5 = Watch(byName_2)
language = Orchid.Common.Revit.Language()
watch_6 = Watch(language)
culture_3 = Orchid.Common.Language.Culture(language=language)
watch_7 = Watch(culture_3)

# group: Modify percentage
code_block_2 = CodeBlock { 4; ",,"; }
setPercentage = Orchid.Common.Culture.SetPercentage(culture=edit, digit=code_block_2.out0, decimal=code_block_2.out1)
setPercentageSymbol = Orchid.Common.Culture.SetPercentageSymbol(culture=setPercentage)

# group: Modify number
code_block_3 = CodeBlock { 4; ","; }
setNumber = Orchid.Common.Culture.SetNumber(culture=edit, digit=code_block_3.out0, decimal=code_block_3.out1)
setNumberSymbol = Orchid.Common.Culture.SetNumberSymbol(culture=setNumber)

# group: Modify currency
code_block_4 = CodeBlock { 4; ".."; "#"; }
setCurrency = Orchid.Common.Culture.SetCurrency(culture=edit, digit=code_block_4.out0, decimal=code_block_4.out1)
setCurrencySymbol = Orchid.Common.Culture.SetCurrencySymbol(culture=setCurrency, symbol=code_block_4.out2)

type = Object.Type()  # unwired: obj

# group: All Languages
all_2 = Orchid.Common.Language.All()
watch_8 = Watch(all_2)
