# Dynamo graph Dictionary.dyn (Dynamo 2.0.3.8810)

# group: Initiate Dictionary
code_block = CodeBlock { "a".."h"; 1..8; }
byKeysValues = DesignScript.Builtin.Dictionary.ByKeysValues(keys=code_block.out0, values=code_block.out1)

values = DesignScript.Builtin.Dictionary.Values(dictionary=byKeysValues)
watch = Watch(values)
keys = DesignScript.Builtin.Dictionary.Keys(dictionary=byKeysValues)
watch_2 = Watch(keys)
code_block_2 = CodeBlock { "a"; }
valueAtKey = DesignScript.Builtin.Dictionary.ValueAtKey(dictionary=byKeysValues, key=code_block_2)
await_ = Orchid.Common.DataStream.Await(pass=byKeysValues, waitFor=valueAtKey)
code_block_3 = CodeBlock { "a".."h"; 9..16; }
setValueAtKeys = DesignScript.Builtin.Dictionary.SetValueAtKeys(dictionary=await_, keys=code_block_3.out0, values=code_block_3.out1)
components = DesignScript.Builtin.Dictionary.Components(dictionary=setValueAtKeys)
watch_3 = Watch(components.keys)
watch_4 = Watch(components.values)
watch_5 = Watch(valueAtKey)
count = DesignScript.Builtin.Dictionary.Count(dictionary=byKeysValues)
watch_6 = Watch(count)
code_block_4 = CodeBlock { "a"; }
removeKeys = DesignScript.Builtin.Dictionary.RemoveKeys(dictionary=setValueAtKeys, keys=code_block_4)
components_2 = DesignScript.Builtin.Dictionary.Components(dictionary=removeKeys)
watch_7 = Watch(components_2.keys)
watch_8 = Watch(components_2.values)
