# Dynamo graph File.NewProject.dyn (Dynamo 2.0.3.8810)

# group: Template and New Projects
directory_path = StringInput(".\testSet\")  # graph input
project_file_name = CodeBlock { ["new3", "new4"]; }
extension = StringInput(".rvt")  # graph input
code_block = CodeBlock(a=directory_path, b=project_file_name, c=extension) { a+b+c; }
template_path = StringInput("C:\ProgramData\Autodesk\RVT 2019\Templates\DanEDU\DanEDU Systems.rte")  # graph input

newProject = Orchid.RevitProject.Common.Document.NewProject(file=code_block, template=template_path)
watch = Watch(newProject)

# group: Template and New Projects
directory_path_2 = StringInput(".\testSet\")  # graph input
project_file_name_2 = CodeBlock { ["new1", "new2"]; }
extension_2 = StringInput(".rvt")  # graph input
code_block_2 = CodeBlock(a=directory_path_2, b=project_file_name_2, c=extension_2) { a+b+c; }
template_path_2 = StringInput("C:\ProgramData\Autodesk\RVT 2019\Templates\DanEDU\DanEDU Building.rte")  # graph input

create = List.Create(item0=template_path_2, item1=template_path)
newProject_2 = Orchid.RevitProject.Common.Document.NewProject(file=code_block_2, template=create)
watch_2 = Watch(newProject_2)
