# Dynamo graph Info-Clipboard.dyn (Dynamo 2.6.1.8786)
# packages: Orchid 206.3.0.7978

# group: Current document Info and copy to clipboard
info = Orchid.RevitProject.Common.Document.Info()
copyTo = Orchid.Common.Clipboard.CopyTo(object=info)

watch = Watch(info)

# group: File Info and copy to clipboard
path_and_filename = CodeBlock { cur = Orchid.Common.Directory.Current; cur + "\\families"; }
contents = Orchid.Common.Directory.Contents(directory=path_and_filename.out1)
info_2 = Orchid.Common.File.Info(file=contents)
copyTo_2 = Orchid.Common.Clipboard.CopyTo(object=info_2)

watch_2 = Watch(info_2)
watch_3 = Watch(copyTo_2)
watch_4 = Watch(copyTo)

# group: Clipboard --> copy int
code_block = CodeBlock { 1..5; }
watch_5 = Watch(code_block)
copyTo_3 = Orchid.Common.Clipboard.CopyTo(object=code_block)  # frozen

# group: Clipboard --> copy element
elementHasMaterial = Orchid.RevitProject.Elements.Selection.ElementHasMaterial()
watch_6 = Watch(elementHasMaterial.Element)
copyTo_4 = Orchid.Common.Clipboard.CopyTo(object=elementHasMaterial.Element)  # frozen
