# Dynamo graph List.IncrementalCount.dyn (Dynamo 2.0.4.12684)

list_values = CodeBlock()
# ---------- list_values.designscript (6 lines) ----------
[
"a","a", 0,
[],null,"",
"something",
"whatever"
];
# ----------------------------------------
code_block = CodeBlock(list=list_values) { Orchid.Common.List.IncrementalCount(list); }
watch = Watch(code_block)
incrementalCount = Orchid.Common.List.IncrementalCount(list=list_values)
watch_2 = Watch(incrementalCount)
searchfor_values = CodeBlock()
# ---------- searchfor_values.designscript (8 lines) ----------
//default values
[[], null, ""];

//various test values
[[]];
"something";
["something", []];
[[], null, 0, "", "whatever"];
# ----------------------------------------
list_values_2 = CodeBlock()
# ---------- list_values_2.designscript (9 lines) ----------
[
"a","a", 0,
[],null,"",
"something",
[[["in",[]],
"several",null],
"depths","",0],
"whatever"
];
# ----------------------------------------
incrementalCount_2 = Orchid.Common.List.IncrementalCount(list=list_values_2)
watch_3 = Watch(incrementalCount_2)
watch_4 = Watch(list_values_2)
