# Dynamo graph List.SummationByKey.dyn (Dynamo 2.6.1.8786)
# packages: Orchid 206.3.0.7978

code_block = CodeBlock { "Walls"; }
byName = Category.ByName(name=code_block)
all_elements_of_category = ElementsOfCategory(Category=byName)
code_block_2 = CodeBlock { "Area"; }
getParameterValueByName = Element.GetParameterValueByName(element=all_elements_of_category, parameterName=code_block_2)
code_block_3 = CodeBlock { "Family"; }
getParameterValueByName_2 = Element.GetParameterValueByName(element=all_elements_of_category, parameterName=code_block_3)
summationByKey = Orchid.Common.List.SummationByKey(list=getParameterValueByName, keys=getParameterValueByName_2)
watch = Watch(summationByKey.unique_keys)
watch_2 = Watch(summationByKey.summarized_groups)
groupByKey = List.GroupByKey(list=getParameterValueByName, keys=getParameterValueByName_2)
watch_3 = Watch(groupByKey.groups)
watch_4 = Watch(groupByKey.unique_keys)
code_block_4 = CodeBlock(x=getParameterValueByName) { x:int[]; }
type = Object.Type(obj=code_block_4)
type_2 = Object.Type(obj=summationByKey.summarized_groups)
type_3 = Object.Type(obj=groupByKey.groups)
groupByEqual = Orchid.Common.List.GroupByEqual(list=getParameterValueByName_2)
watch_5 = Watch(groupByEqual.groups)
watch_6 = Watch(groupByEqual.unique_keys)
name = Element.Name(element=groupByKey.unique_keys)
watch_7 = Watch(name)
