# Dynamo graph PDFexport.dyn (Dynamo 2.10.1.3976)
# packages: Orchid 210.0.0.7778

# note: Export Setting may be set
# both as an element and
# as a string
string = StringInput("Default")  # graph input

# group: SheetSet
categories = Categories("OST_RampsAboveCut")  # graph input; frozen
all_elements_of_category = ElementsOfCategory(Category=categories)
string_2 = StringInput("testSet")  # graph input
create = Orchid.RevitProject.Views.SheetSet.Create(view=all_elements_of_category, name=string_2)
getView = Orchid.RevitProject.Views.SheetSet.GetView(viewSheetSet=create)
sheet_set = SheetSet("A3 set")  # graph input
change = Orchid.RevitProject.Views.SheetSet.Change(view=getView, viewSheetSet=sheet_set)
delete = Orchid.RevitProject.Views.SheetSet.Delete(viewSheetSet=create)

# group: Merge PDF files
code_block = CodeBlock()
# ---------- code_block.designscript (6 lines) ----------
//input documents
["%userprofile%\\Downloads\\PDF\\pdf1.pdf",
"%userprofile%\\Downloads\\PDF\\pdf2.pdf"];

//output file path
"%userprofile%\\Downloads\\PDF\\result.pdf";
# ----------------------------------------
mergePDF = Orchid.Common.File.MergePDF(documents=code_block.out0, filePath=code_block.out1)  # frozen

sheet_set_2 = SheetSet("A3 set")  # graph input
getView_2 = Orchid.RevitProject.Views.SheetSet.GetView(viewSheetSet=sheet_set_2)

# group: filePath --> file name incl. path
current = Orchid.Common.Directory.Current()
sheetNumber = Sheet.SheetNumber(sheet=getView_2)
code_block_2 = CodeBlock(a=current, b=sheetNumber) { a + "\\" + b; }
boolean = BoolSelector(false)  # graph input
pdfexport_quality = ExportQuality("DPI300")

byView = Orchid.Common.PDFexport.ByView(fileName=code_block_2, combine=boolean, view=getView_2)
byViewSheetSet = Orchid.Common.PDFexport.ByViewSheetSet(combine=boolean, viewSheetSet=sheet_set_2)  # frozen
string_3 = StringInput("testSetting")  # graph input
createSetting = Orchid.Common.PDFexport.CreateSetting(name=string_3)
pdfexport_papersizes = PaperSize("ISO A3 : 297 x 420 mm")
print_pageorientation = PageOrientation("Portrait")  # graph input
print_paperplacement = PaperPlacement("Lower Left")  # graph input
print_margintype = MarginType("User defined")  # graph input
code_block_3 = CodeBlock { [10,10]; }
print_zoomtype = ZoomType("Zoom")  # graph input
code_block_4 = CodeBlock { 100; }
changeSetting = Orchid.Common.PDFexport.ChangeSetting(exportSetting=createSetting, paperZize=pdfexport_papersizes, pageOrientation=print_pageorientation, paperPlacement=print_paperplacement, marginType=print_margintype, margin=code_block_3, zoomType=print_zoomtype, zoom=code_block_4)

# group: Remove print setting
# note: Export Setting may be set
# both as an element and
# as a string
string_4 = StringInput("testSetting")  # graph input
deleteSetting = Orchid.Common.PDFexport.DeleteSetting(exportSetting=string_4)  # frozen
export_setting = Setting("testSetting")

# group: Print current view (center and fit to page)
string_5 = StringInput("testSetting")  # graph input
pdfexport_papersizes_2 = PaperSize("<Use Sheet Size>")
print_paperplacement_2 = PaperPlacement("Center")  # graph input
print_zoomtype_2 = ZoomType("Fit To Page")  # graph input
createSetting_2 = Orchid.Common.PDFexport.CreateSetting(name=string_5, paperZize=pdfexport_papersizes_2, paperPlacement=print_paperplacement_2, zoomType=print_zoomtype_2)
activeView = Orchid.RevitProject.Common.Document.ActiveView()
byView_2 = Orchid.Common.PDFexport.ByView(view=activeView, exportSetting=createSetting_2)
# note: if export options there are rarely set need to be included, then connect:
# "Export.SetOptions" output ExportSetting to "Export.ByView" input exportSetting!
await_ = Orchid.Common.DataStream.Await(pass=createSetting_2, waitFor=byView_2)
deleteSetting_2 = Orchid.Common.PDFexport.DeleteSetting(exportSetting=await_)

# group: Print options there are rarely set
boolean_2 = BoolSelector(true)  # graph input
boolean_3 = BoolSelector(false)  # graph input
print_rasterquality = RasterQuality("Medium")
print_colordepth = ColorDepthType("Gray Scale")  # graph input
setOptions = Orchid.Common.PDFexport.SetOptions(exportSetting=createSetting_2, viewLinksinBlue=boolean_2, hideReforWorkPlanes=boolean_3, hideUnreferencedViewTags=boolean_2, maskCoincidentLines=boolean_2, hideScopeBoxes=boolean_3, hideCropBoundaries=boolean_3, replaceHalftoneWithThinLines=boolean_2, createOutputUsing=boolean_2, rasterQuality=print_rasterquality, colorDepth=print_colordepth)  # frozen

export_setting_2 = Setting("Default")
paperSize = Orchid.Common.PDFexport.PaperSize()
watch = Watch(paperSize)
