# Dynamo graph String.dyn (Dynamo 2.0.3.8810)

# group: Import from txt file
string = StringInput("..\..\Data\test.txt")  # graph input
fromPath = FileObject(path=string)  # "File.FromPath"
readText = FileSystem.ReadText(file=fromPath)

string_2 = StringInput("\"Boolean.FaceFlipped|DanEDU\"")  # graph input
string_3 = StringInput("\"Boolean.Flipped|DanEDU\"")  # graph input
create = List.Create(item0=string_2, item1=string_3)
string_4 = StringInput("\"FamilyInstance.IsFaceFlipped\"")  # graph input
string_5 = StringInput("\"FamilyInstance.IsFlipped\"")  # graph input
create_2 = List.Create(item0=string_4, item1=string_5)

# group: Replace string
replace = Orchid.Common.String.Replace(string=readText, searchFor=create, replaceWith=create_2)
watch = Watch(replace)

string_6 = StringInput("e\">")  # graph input
count = List.Count(list=create)
cycle = List.Cycle(list=string_6, amount=count)

# group: Get substring
substring = Orchid.Common.String.Substring(string=readText, startsWith=create, endsWith=cycle)
watch_2 = Watch(substring)
