# Dynamo graph Analytical areaload.dyn (Dynamo 2.0.3.8810)

# group: Input
categories = Categories(index=208)
all_elements_of_category = ElementsOfCategory(Category=categories)

# group: Get the "Structural Walls"
code_block = CodeBlock { "Structural"; }
getParameterValueByName = Element.GetParameterValueByName(element=all_elements_of_category, parameterName=code_block)
code_block_2 = CodeBlock(key=getParameterValueByName) { key == 1 ? true : false; }
filterByBoolMask = List.FilterByBoolMask(list=all_elements_of_category, mask=code_block_2)
getAnalytical = Orchid.RevitProject.Elements.SystemFamily.GetAnalytical(element=filterByBoolMask.in)

# group: Import from Excel
string = StringInput(".\Structural Loads.xlsx")  # graph input
fromPath = FileObject(path=string)  # "File.FromPath"
string_2 = StringInput("Sheet1")  # graph input
boolean = BoolSelector(true)
boolean_2 = BoolSelector(false)
importExcel = Data.ImportExcel(file=fromPath, sheetName=string_2, readAsStrings=boolean, showExcel=boolean_2)
code_block_3 = CodeBlock { 0; }
removeItemAtIndex = List.RemoveItemAtIndex(list=importExcel, indices=code_block_3)
transpose = List.Transpose(lists=removeItemAtIndex)

# group: Compares data in Excel, with the floors, and adds the appropriate value to the analytical floors
code_block_4 = CodeBlock()
# ---------- code_block_4.designscript (5 lines) ----------
[
"Variable load [kN/m2]",
"Snowload [kN/m2]",
"Deadload [kN/m2]"
];
# ----------------------------------------
code_block_5 = CodeBlock(list=transpose) { list[0]; list[1]; }
byKeysValues = DesignScript.Builtin.Dictionary.ByKeysValues(keys=code_block_5.out0, values=code_block_5.out1)
getParameterValueByName_2 = Element.GetParameterValueByName(element=filterByBoolMask.in, parameterName=code_block_4, lacing=Longest)
valueAtKey = DesignScript.Builtin.Dictionary.ValueAtKey(dictionary=byKeysValues, key=getParameterValueByName_2)
setParameterByName = Element.SetParameterByName(element=getAnalytical, parameterName=code_block_4, value=valueAtKey, lacing=Longest)

# group: Remove old loads
categories_2 = Categories(index=563)
all_elements_of_category_2 = ElementsOfCategory(Category=categories_2)
delete = Orchid.RevitProject.Elements.Element.Delete(element=all_elements_of_category_2)

# group: Adds load corresponding to the analytical floor (kN/m2)
element_types = ElementTypes(index=14)
all_elements_of_type = ElementsOfType(element_type=element_types)
await_ = Orchid.Common.DataStream.Await(pass=getAnalytical, waitFor=setParameterByName)
getParameterValueByName_3 = Element.GetParameterValueByName(element=await_, parameterName=code_block_4, lacing=Longest)
await_2 = Orchid.Common.DataStream.Await(pass=getParameterValueByName_3, waitFor=delete)
code_block_6 = CodeBlock(str=await_2) { String.ToNumber(str) * -1000; }

# group: Load cases
setAreaLoad = Orchid.RevitProject.Elements.SystemFamily.SetAreaLoad(element=all_elements_of_category, areaLoadType=all_elements_of_type, value=code_block_6)
code_block_7 = CodeBlock { "Load Case"; }
categories_3 = Categories(index=553)
all_elements_of_category_3 = ElementsOfCategory(Category=categories_3)
code_block_8 = CodeBlock(load=all_elements_of_category_3)
# ---------- code_block_8.designscript (8 lines) ----------
[
//Live load
load[1],
//Snow load
load[3],
//Dead load
load[0]
];
# ----------------------------------------
setParameterByName_2 = Element.SetParameterByName(element=setAreaLoad, parameterName=code_block_7, value=code_block_8)
name = Element.Name(element=all_elements_of_category_3)
watch = Watch(name)
