# Dynamo graph Category.dyn (Dynamo 2.0.4.12684)

built_in_categories = CodeBlock()
# ---------- built_in_categories.designscript (26 lines) ----------
[
"OST_Casework",
"OST_Ceilings",
"OST_Columns",
"OST_CurtainWallMullions",
"OST_CurtainWallPanels",
"OST_CurtaSystem",
"OST_Doors",
"OST_Entourage",
"OST_Floors",
"OST_Furniture",
"OST_FurnitureSystems",
"OST_GenericModel",
"OST_PlumbingFixtures",
"OST_Ramps",
"OST_Roofs",
"OST_SpecialityEquipment",
"OST_Stairs",
"OST_StructuralColumns",
"OST_StructuralFoundation",
"OST_StructuralFraming",
"OST_StructuralFramingSystem",
"OST_StructuralStiffener",
"OST_Walls",
"OST_Windows"
];
# ----------------------------------------
natural_category_name = CodeBlock()
# ---------- natural_category_name.designscript (26 lines) ----------
[
"Casework",
"Ceilings",
"Columns",
"Curtain Wall Mullions",
"Curtain Panels",
"Curtain Systems",
"Doors",
"Entourage",
"Floors",
"Furniture",
"Furniture Systems",
"Generic Models",
"Plumbing Fixtures",
"Ramps",
"Roofs",
"Specialty Equipment",
"Stairs",
"Structural Columns",
"Structural Foundations",
"Structural Framing",
"Structural Beam Systems",
"Structural Stiffeners",
"Walls",
"Windows"
];
# ----------------------------------------

# group: SubCategory
byCategory = Orchid.RevitProject.Elements.SubCategory.ByCategory(category=natural_category_name)
watch = Watch(byCategory)
code_block = CodeBlock(list=byCategory) { list[0][3]; }
string_from_object = FromObject(obj=code_block)
byName = Orchid.RevitProject.Elements.SubCategory.ByName(name=string_from_object)
watch_2 = Watch(byName)

# group: SubCategory
code_block_2 = CodeBlock { "Casework"; "Cabinet"; "Test"; }
byName_2 = Orchid.RevitProject.Elements.SubCategory.ByName(category=code_block_2.out0, name=code_block_2.out1)
watch_3 = Watch(byName_2)
create = Orchid.RevitProject.Elements.SubCategory.Create(category=code_block_2.out0, name=code_block_2.out2)
watch_4 = Watch(create)
remove = Orchid.RevitProject.Elements.SubCategory.Remove(category=code_block_2.out0, subCategory=create)
watch_5 = Watch(remove)

# group: Category --> InDocument
inDocument = Orchid.RevitProject.Elements.Category.InDocument()
watch_6 = Watch(inDocument)

code_block_3 = CodeBlock()
# ---------- code_block_3.designscript (9 lines) ----------
"Model";
"Annotation";
"AnalyticalModel";
"Internal";

["Model",
"Annotation",
"AnalyticalModel",
"Internal"];
# ----------------------------------------

# group: Category --> ByCategoryType
byCategoryType = Orchid.RevitProject.Elements.Category.ByCategoryType(categoryType=code_block_3.out0)
watch_7 = Watch(byCategoryType)

# group: Category --> BuiltInCategory and CategoryType
builtInCategory = Orchid.RevitProject.Elements.Category.BuiltInCategory()
watch_8 = Watch(builtInCategory)
categoryType = Orchid.RevitProject.Elements.Category.CategoryType(category=builtInCategory)
groupByKey = List.GroupByKey(list=builtInCategory, keys=categoryType)
watch_9 = Watch(groupByKey.groups)
watch_10 = Watch(groupByKey.unique_keys)
watch_11 = Watch(categoryType)
