# Dynamo graph ElementRoom.dyn (Dynamo 2.0.4.12684)

# group: Room elements
code_block = CodeBlock { "Rooms"; }
elementByCategory = Orchid.RevitProject.Elements.Selection.ElementByCategory(category=code_block)
geometry = Element.Geometry(element=elementByCategory.Element)
boundingBox = Geometry.BoundingBox(geometry=geometry)
flatten = List.Flatten(list=boundingBox)

# group: FamilyInstance elements
code_block_2 = CodeBlock { ["Doors","Windows"]; }
elementByCategory_2 = Orchid.RevitProject.Elements.Selection.ElementByCategory(category=code_block_2)
flatten_2 = List.Flatten(list=elementByCategory_2.Element)
getFromToCalculationPoints = Orchid.RevitProject.Elements.FamilyInstance.GetFromToCalculationPoints(familyInstance=flatten_2)
lastItem = List.LastItem(list=getFromToCalculationPoints, lacing=Longest)
pointInside = Orchid.Common.Geometry.BoundingBox.PointInside(boundingBox=flatten, point=lastItem, lacing=CrossProduct)
firstItem = List.FirstItem(list=getFromToCalculationPoints, lacing=Longest)
pointInside_2 = Orchid.Common.Geometry.BoundingBox.PointInside(boundingBox=flatten, point=firstItem, lacing=CrossProduct)

# group: Set parameter value
filterByBoolMask = List.FilterByBoolMask(list=flatten_2, mask=pointInside_2@L2)
code_block_3 = CodeBlock { "Number"; "Comments"; }
getParameterValueByName = Element.GetParameterValueByName(element=elementByCategory.Element, parameterName=code_block_3.out0)
setParameterByName = Element.SetParameterByName(element=filterByBoolMask.in, parameterName=code_block_3.out1, value=getParameterValueByName)
await_ = Orchid.Common.DataStream.Await(pass=pointInside, waitFor=setParameterByName)
filterByBoolMask_2 = List.FilterByBoolMask(list=flatten_2, mask=await_@L2)
setParameterByName_2 = Element.SetParameterByName(element=filterByBoolMask_2.in, parameterName=code_block_3.out1, value=getParameterValueByName)

# group: Solid intersect element
elementIntersect = Orchid.Common.Geometry.Solid.ElementIntersect(solid=geometry)
watch = Watch(elementIntersect)
elementIntersect_2 = Orchid.Common.Geometry.Solid.ElementIntersect(solid=geometry, elements=flatten_2)
watch_2 = Watch(elementIntersect_2)

# group: Boundingbox intersect element
elementIntersect_3 = Orchid.Common.Geometry.BoundingBox.ElementIntersect(boundingBox=boundingBox)
watch_3 = Watch(elementIntersect_3)
elementIntersect_4 = Orchid.Common.Geometry.BoundingBox.ElementIntersect(boundingBox=boundingBox, elements=flatten_2)
watch_4 = Watch(elementIntersect_4)

watch_5 = Watch(filterByBoolMask.in)
watch_6 = Watch(filterByBoolMask_2.in)
watch_7 = Watch(flatten_2)
watch_8 = Watch(elementByCategory.Element)
