# Dynamo graph Family-Associated.dyn (Dynamo 2.0.3.8810)

categories = Categories(index=230)  # graph input
all_elements_of_category = ElementsOfCategory(Category=categories)
elementType = Element.ElementType(element=all_elements_of_category)
family = FamilyType.Family(familyType=elementType)
hasAssociated = Orchid.RevitProject.Elements.Family.HasAssociated(family=family)
watch = Watch(hasAssociated)
watch_2 = Watch(family)
watch_3 = Watch(elementType)
hasAssociated_2 = Orchid.RevitProject.Elements.FamilyType.HasAssociated(familyType=elementType)
watch_4 = Watch(hasAssociated_2)
