# Dynamo graph Family.Save.dyn (Dynamo 2.0.4.12684)

# group: selected families by category in project
natural_category_name = CodeBlock()
# ---------- natural_category_name.designscript (12 lines) ----------
[
"Casework",
"Columns",
"Doors",
"Windows",
"Specialty Equipment",
"Structural Columns",
"Structural Foundations",
"Structural Framing",
"Structural Beam Systems",
"Structural Stiffeners"
];
# ----------------------------------------
elementByCategory = Orchid.RevitProject.Elements.Selection.ElementByCategory(category=natural_category_name)
string = StringInput(".\testSet")  # graph input
boolean = BoolSelector(false)  # graph input

elementType = Element.ElementType(element=elementByCategory.Element)

# group (continued): selected families by category in project
uniqueItems = List.UniqueItems(list=elementType, lacing=Longest)
flatten = List.Flatten(list=uniqueItems)
family = FamilyType.Family(familyType=flatten)
save = Orchid.RevitProject.Elements.Family.Save(family=family, path=string, subfolder=boolean)

watch = Watch(save)
