# Dynamo graph Flipped.dyn (Dynamo 2.3.0.5885)
# packages: Orchid 230.1.0.7731

code_block = CodeBlock { "Doors"; }
byName = Category.ByName(name=code_block)
all_elements_of_category = ElementsOfCategory(Category=byName)
watch = Watch(all_elements_of_category)

# group: Element
setParameterByName = Element.SetParameterByName()  # unwired: element, parameterName, value
code_block_2 = CodeBlock(data=all_elements_of_category) { data; }
faceFlipped = Orchid.RevitProject.Elements.FamilyInstance.FaceFlipped(familyInstance=code_block_2)
code_block_3 = CodeBlock { "Opening Side"; "in"; "out"; }
function_apply = ApplyFunction(func=setParameterByName, arg1=faceFlipped.false, arg2=code_block_3.out0, arg3=code_block_3.out2)
clean = Orchid.Common.List.Clean(list=function_apply)
# note: If an element dont include the needed parameter will a normal node fail, however, using Function.Apply will prevent from that!
function_apply_2 = ApplyFunction(func=setParameterByName, arg1=faceFlipped.true, arg2=code_block_3.out0, arg3=code_block_3.out1)
clean_2 = Orchid.Common.List.Clean(list=function_apply_2)

watch_2 = Watch(clean)
watch_3 = Watch(clean_2)

# group: Boolean
code_block_4 = CodeBlock(data=all_elements_of_category) { data; }
isHandFlipped = Orchid.RevitProject.Elements.FamilyInstance.IsHandFlipped(familyInstance=code_block_4)
groupByKey = List.GroupByKey(list=code_block_4, keys=isHandFlipped)
isFaceFlipped = Orchid.RevitProject.Elements.FamilyInstance.IsFaceFlipped(familyInstance=code_block_4)
groupByKey_2 = List.GroupByKey(list=code_block_4, keys=isFaceFlipped)

watch_4 = Watch(groupByKey.groups)
watch_5 = Watch(groupByKey_2.groups)
code_block_5 = CodeBlock { "Walls"; }
byName_2 = Category.ByName(name=code_block_5)
all_elements_of_category_2 = ElementsOfCategory(Category=byName_2)

# group: Boolean
code_block_6 = CodeBlock(data=all_elements_of_category_2) { data; }
isFlipped = Orchid.RevitProject.Elements.Wall.IsFlipped(wall=code_block_6)
groupByKey_3 = List.GroupByKey(list=code_block_6, keys=isFlipped)

watch_6 = Watch(groupByKey_3.groups)

# group: Element
code_block_7 = CodeBlock(data=all_elements_of_category_2) { data; }
flipped = Orchid.RevitProject.Elements.Wall.Flipped(wall=code_block_7)
code_block_8 = CodeBlock { "Comments"; "Is flipped"; "Not flipped"; }
setParameterByName_2 = Element.SetParameterByName(element=flipped.false, parameterName=code_block_8.out0, value=code_block_8.out2)
setParameterByName_3 = Element.SetParameterByName(element=flipped.true, parameterName=code_block_8.out0, value=code_block_8.out1)

watch_7 = Watch(setParameterByName_2)
watch_8 = Watch(setParameterByName_3)
hashing = Orchid.Common.Object.Hashing(object=all_elements_of_category_2)
watch_9 = Watch(hashing)
watch_10 = Watch(groupByKey.unique_keys)
watch_11 = Watch(groupByKey_2.unique_keys)
watch_12 = Watch(groupByKey_3.unique_keys)

# group: Element
code_block_9 = CodeBlock(data=all_elements_of_category) { data; }
handFlipped = Orchid.RevitProject.Elements.FamilyInstance.HandFlipped(familyInstance=code_block_9)
code_block_10 = CodeBlock { "Hinge Side"; "R"; "L"; }
setParameterByName_4 = Element.SetParameterByName(element=handFlipped.false, parameterName=code_block_10.out0, value=code_block_10.out2)
setParameterByName_5 = Element.SetParameterByName(element=handFlipped.true, parameterName=code_block_10.out0, value=code_block_10.out1)

watch_13 = Watch(setParameterByName_4)
watch_14 = Watch(setParameterByName_5)
handOrientation = Orchid.RevitProject.Elements.FamilyInstance.HandOrientation(familyInstance=all_elements_of_category)
watch_15 = Watch(handOrientation)
