# Dynamo graph Selection.dyn (Dynamo 2.0.4.12684)

built_in_categories = CodeBlock()
# ---------- built_in_categories.designscript (26 lines) ----------
[
"OST_Casework",
"OST_Ceilings",
"OST_Columns",
"OST_CurtainWallMullions",
"OST_CurtainWallPanels",
"OST_CurtaSystem",
"OST_Doors",
"OST_Entourage",
"OST_Floors",
"OST_Furniture",
"OST_FurnitureSystems",
"OST_GenericModel",
"OST_PlumbingFixtures",
"OST_Ramps",
"OST_Roofs",
"OST_SpecialityEquipment",
"OST_Stairs",
"OST_StructuralColumns",
"OST_StructuralFoundation",
"OST_StructuralFraming",
"OST_StructuralFramingSystem",
"OST_StructuralStiffener",
"OST_Walls",
"OST_Windows"
];
# ----------------------------------------
natural_category_name = CodeBlock()
# ---------- natural_category_name.designscript (26 lines) ----------
[
"Casework",
"Ceilings",
"Columns",
"Curtain Wall Mullions",
"Curtain Panels",
"Curtain Systems",
"Doors",
"Entourage",
"Floors",
"Furniture",
"Furniture Systems",
"Generic Models",
"Plumbing Fixtures",
"Ramps",
"Roofs",
"Specialty Equipment",
"Stairs",
"Structural Columns",
"Structural Foundations",
"Structural Framing",
"Structural Beam Systems",
"Structural Stiffeners",
"Walls",
"Windows"
];
# ----------------------------------------

# group: Selection by element
elementByCategory = Orchid.RevitProject.Elements.Selection.ElementByCategory(category=natural_category_name)
watch = Watch(elementByCategory.Element)
elementHasMaterial = Orchid.RevitProject.Elements.Selection.ElementHasMaterial()
watch_2 = Watch(elementHasMaterial.Element)
watch_3 = Watch(elementHasMaterial.Category)
watch_4 = Watch(elementByCategory.Category)

# group: OOTB nodes
byName = Category.ByName(name=natural_category_name)
all_elements_of_category = ElementsOfCategory(Category=byName)
clean = Orchid.Common.List.Clean(list=all_elements_of_category)
watch_5 = Watch(clean)

code_block = CodeBlock()
# ---------- code_block.designscript (9 lines) ----------
"Model";
"Annotation";
"AnalyticalModel";
"Internal";

["Model",
"Annotation",
"AnalyticalModel",
"Internal"];
# ----------------------------------------

# group: Selection by element
elementByCategoryType = Orchid.RevitProject.Elements.Selection.ElementByCategoryType(categoryType=code_block.out0)
watch_6 = Watch(elementByCategoryType.Element)
watch_7 = Watch(elementByCategoryType.CategoryType)
watch_8 = Watch(elementByCategoryType.Category)

# group: Family
code_block_2 = CodeBlock()
# ---------- code_block_2.designscript (2 lines) ----------
["Doors",
"Windows"];
# ----------------------------------------
byName_2 = Category.ByName(name=code_block_2)
byCategory = Orchid.RevitProject.Elements.Family.ByCategory(category=byName_2)
watch_9 = Watch(byCategory)
all = Orchid.RevitProject.Elements.Family.All()
watch_10 = Watch(all.Category)
watch_11 = Watch(all.Family)

# group: FamilyType
code_block_3 = CodeBlock()  # same code as code_block_2
byCategory_2 = Orchid.RevitProject.Elements.FamilyType.ByCategory(category=code_block_3)
watch_12 = Watch(byCategory_2)
all_2 = Orchid.RevitProject.Elements.FamilyType.All()
watch_13 = Watch(all_2.FamilyType)
watch_14 = Watch(all_2.Category)

# group: Converters Note: FamilyType in a project document is denoted FamilySymbol in the Autodesk Revit API!
toRevitType = Orchid.RevitProject.Elements.Element.ToRevitType(element=byCategory_2)
toDynamoType = Orchid.RevitProject.Elements.Element.ToDynamoType(element=toRevitType)
name = Element.Name(element=toDynamoType)
watch_15 = Watch(name)
watch_16 = Watch(toDynamoType)
watch_17 = Watch(toRevitType)

# group: Converters
toRevitType_2 = Orchid.RevitProject.Elements.Category.ToRevitType(category=byName)
toDynamoType_2 = Orchid.RevitProject.Elements.Category.ToDynamoType(category=toRevitType_2)
watch_18 = Watch(toDynamoType_2)

# group: Model elements
modelElement = Orchid.RevitProject.Elements.Selection.ModelElement()
watch_19 = Watch(modelElement.Element)
watch_20 = Watch(modelElement.Category)

# group: Selection by level
levels = Levels(index=0)
boolean = BoolSelector(true)
elementByLevel = Orchid.RevitProject.Elements.Selection.ElementByLevel(level=levels, spatial=boolean)
watch_21 = Watch(elementByLevel.Element)
watch_22 = Watch(elementByLevel.Category)

# group: Selection by element type
boolean_2 = BoolSelector(false)
elementTypeHasMaterial = Orchid.RevitProject.Elements.Selection.ElementTypeHasMaterial(library=boolean_2)
watch_23 = Watch(elementTypeHasMaterial.ElementType)
watch_24 = Watch(elementTypeHasMaterial.Category)

# group: Selection by element type
boolean_3 = BoolSelector(false)
elementTypeByCategoryType = Orchid.RevitProject.Elements.Selection.ElementTypeByCategoryType(categoryType=code_block.out0, library=boolean_3)
watch_25 = Watch(elementTypeByCategoryType.ElementType)
watch_26 = Watch(elementTypeByCategoryType.CategoryType)
watch_27 = Watch(elementTypeByCategoryType.Category)

# group: Selection
elementByFamily = Orchid.RevitProject.Elements.Selection.ElementByFamily(family=byCategory)
watch_28 = Watch(elementByFamily)

code_block_4 = CodeBlock()
# ---------- code_block_4.designscript (3 lines) ----------
["Rooms",
"Spaces",
"Areas"];
# ----------------------------------------
