# Dynamo graph SetType-Random.dyn (Dynamo 2.0.3.8810)

# group: Collect elements
family_types = FamilyTypes(index=41)  # graph input
family_types_2 = FamilyTypes(index=40)  # graph input
create = List.Create(item0=family_types, item1=family_types_2)
all_elements_of_family_type = ElementsOfFamilyType(Family_Type=create)

flatten = List.Flatten(list=all_elements_of_family_type)
asFamilyInstance = CurtainPanel.AsFamilyInstance(curtainPanel=flatten)

# group: Randomization
count = List.Count(list=flatten)
randomList = Orchid.Common.Math.RandomList(amount=count)
round = Math.Round(number=randomList)

getItemAtIndex = List.GetItemAtIndex(list=create, index=round)

# group: SetType
setType = Orchid.RevitProject.Elements.FamilyInstance.SetType(familyInstance=asFamilyInstance, familyType=getItemAtIndex)

# group: Random
code_block = CodeBlock { 4; }
random = Orchid.Common.Math.Random(range=code_block)
watch = Watch(random)
randomList_2 = Orchid.Common.Math.RandomList(amount=count, range=code_block)
watch_2 = Watch(randomList_2)
