# Dynamo graph SpatialElement.dyn (Dynamo 2.6.1.8786)
# packages: Orchid 206.3.0.7978

# group: Spatial Elements
getBoundary = Orchid.RevitProject.Elements.SpatialElement.GetBoundary()
watch = Watch(getBoundary.SpatialElement)
watch_2 = Watch(getBoundary.Element)
getSeparationLine = Orchid.RevitProject.Elements.SpatialElement.GetSeparationLine()
watch_3 = Watch(getSeparationLine.SpatialElement)
watch_4 = Watch(getSeparationLine.Element)
watch_5 = Watch(getBoundary.Curve)
watch_6 = Watch(getSeparationLine.Curve)

# group: Rooms, Spaces, Areas
getAreaBoundary = Orchid.RevitProject.Elements.SpatialElement.GetAreaBoundary()
watch_7 = Watch(getAreaBoundary.Area)
watch_8 = Watch(getAreaBoundary.Element)
getSpaceBoundary = Orchid.RevitProject.Elements.SpatialElement.GetSpaceBoundary()
watch_9 = Watch(getSpaceBoundary.Space)
watch_10 = Watch(getSpaceBoundary.Element)
getRoomBoundary = Orchid.RevitProject.Elements.SpatialElement.GetRoomBoundary()
watch_11 = Watch(getRoomBoundary.Room)
watch_12 = Watch(getRoomBoundary.Element)
watch_13 = Watch(getRoomBoundary.Curve)
watch_14 = Watch(getSpaceBoundary.Curve)
watch_15 = Watch(getAreaBoundary.Curve)

code_block = CodeBlock { "Rooms"; "Spaces"; "Areas"; }
byName = Category.ByName(name=code_block.out0)
all_elements_of_category = ElementsOfCategory(Category=byName)
getSeparationLine_2 = Orchid.RevitProject.Elements.SpatialElement.GetSeparationLine(spatialElement=all_elements_of_category)
watch_16 = Watch(getSeparationLine_2.SpatialElement)
watch_17 = Watch(getSeparationLine_2.Element)
getBoundary_2 = Orchid.RevitProject.Elements.SpatialElement.GetBoundary(spatialElement=all_elements_of_category)
watch_18 = Watch(getBoundary_2.SpatialElement)
watch_19 = Watch(getBoundary_2.Element)

# group: Revit links
getRevitLink = Orchid.RevitProject.Common.Link.GetRevitLink()
instance = Orchid.RevitProject.Common.Link.Instance(link=getRevitLink)
document = Orchid.RevitProject.Common.Link.Document(instance=instance)
code_block_2 = CodeBlock { "Rooms"; "Spaces"; "Areas"; }
byName_2 = Category.ByName(name=code_block_2.out0)
elementByCategory = Orchid.RevitProject.Elements.Selection.ElementByCategory(document=document, category=byName_2)
getSeparationLine_3 = Orchid.RevitProject.Elements.SpatialElement.GetSeparationLine(document=document, spatialElement=elementByCategory.Element)
watch_20 = Watch(getSeparationLine_3.Element)
getBoundary_3 = Orchid.RevitProject.Elements.SpatialElement.GetBoundary(document=document, spatialElement=elementByCategory.Element)
watch_21 = Watch(getBoundary_3.Element)
watch_22 = Watch(getSeparationLine_3.SpatialElement)
watch_23 = Watch(getBoundary_3.SpatialElement)
