# Dynamo graph TagLocation.dyn (Dynamo 2.6.1.8786)
# packages: Orchid 206.3.0.7928

# group: Set tag at element location
code_block = CodeBlock { ["Rooms", "Doors"]; "Rooms"; "Doors"; }
byName = Category.ByName(name=code_block.out0)
all_elements_of_category = ElementsOfCategory(Category=byName)
moveTagToLocation = Orchid.RevitProject.Elements.Element.MoveTagToLocation(element=all_elements_of_category)  # frozen

# group: Set tag at element location
code_block_2 = CodeBlock { ["Room Tags", "Door Tags"]; "Room Tags"; "Door Tags"; }
byName_2 = Category.ByName(name=code_block_2.out0)
all_elements_of_category_2 = ElementsOfCategory(Category=byName_2)
moveToHostLocation = Orchid.RevitProject.Annotations.Tag.MoveToHostLocation(tag=all_elements_of_category_2)
