# Dynamo graph Tagging.dyn (Dynamo 2.0.4.12684)

# group: Room tagging
model_views = ModelView(index=3)  # graph input
categories = Categories(index=425)  # graph input
all_elements_of_category = ElementsOfCategory(Category=categories)
code_block = CodeBlock { "Room Tag"; "Text Only"; }
byFamilyNameAndTypeName = FamilyType.ByFamilyNameAndTypeName(familyName=code_block.out0, typeName=code_block.out1)
bySpatialElement = Orchid.RevitProject.Annotations.Tag.BySpatialElement(view=model_views, spatialElement=all_elements_of_category, tagType=byFamilyNameAndTypeName)

watch = Watch(bySpatialElement)

# group: Room tagging by location
model_views_2 = ModelView(index=3)  # graph input
categories_2 = Categories(index=425)  # graph input
all_elements_of_category_2 = ElementsOfCategory(Category=categories_2)
code_block_2 = CodeBlock { "Room Tag"; "Text Only"; }
byFamilyNameAndTypeName_2 = FamilyType.ByFamilyNameAndTypeName(familyName=code_block_2.out0, typeName=code_block_2.out1)
getLocation = Element.GetLocation(element=all_elements_of_category_2)
bySpatialElementAndLocation = Orchid.RevitProject.Annotations.Tag.BySpatialElementAndLocation(view=model_views_2, spatialElement=all_elements_of_category_2, tagType=byFamilyNameAndTypeName_2, location=getLocation)

watch_2 = Watch(bySpatialElementAndLocation)

# group: Space tagging
model_views_3 = ModelView(index=2)  # graph input
categories_3 = Categories(index=457)  # graph input
all_elements_of_category_3 = ElementsOfCategory(Category=categories_3)
code_block_3 = CodeBlock { "Space Tag"; "Text and Area"; }
byFamilyNameAndTypeName_3 = FamilyType.ByFamilyNameAndTypeName(familyName=code_block_3.out0, typeName=code_block_3.out1)
bySpatialElement_2 = Orchid.RevitProject.Annotations.Tag.BySpatialElement(view=model_views_3, spatialElement=all_elements_of_category_3, tagType=byFamilyNameAndTypeName_3)

watch_3 = Watch(bySpatialElement_2)

# group: Space tagging by location
model_views_4 = ModelView(index=2)  # graph input
categories_4 = Categories(index=457)  # graph input
all_elements_of_category_4 = ElementsOfCategory(Category=categories_4)
code_block_4 = CodeBlock { "Space Tag"; "Text and Area"; }
byFamilyNameAndTypeName_4 = FamilyType.ByFamilyNameAndTypeName(familyName=code_block_4.out0, typeName=code_block_4.out1)
getLocation_2 = Element.GetLocation(element=all_elements_of_category_4)
bySpatialElementAndLocation_2 = Orchid.RevitProject.Annotations.Tag.BySpatialElementAndLocation(view=model_views_4, spatialElement=all_elements_of_category_4, tagType=byFamilyNameAndTypeName_4, location=getLocation_2)

watch_4 = Watch(bySpatialElementAndLocation_2)

# group: Element tagging
model_views_5 = ModelView(index=3)  # graph input
categories_5 = Categories(index=159)  # graph input
all_elements_of_category_5 = ElementsOfCategory(Category=categories_5)
code_block_5 = CodeBlock { "Door Tag"; "Hinging"; }
byFamilyNameAndTypeName_5 = FamilyType.ByFamilyNameAndTypeName(familyName=code_block_5.out0, typeName=code_block_5.out1)
byElement = Orchid.RevitProject.Annotations.Tag.ByElement(view=model_views_5, element=all_elements_of_category_5, tagType=byFamilyNameAndTypeName_5)

watch_5 = Watch(byElement)

# group: Element tagging by location
model_views_6 = ModelView(index=3)  # graph input
categories_6 = Categories(index=159)  # graph input
all_elements_of_category_6 = ElementsOfCategory(Category=categories_6)
code_block_6 = CodeBlock { "Door Tag"; "Hinging"; }
byFamilyNameAndTypeName_6 = FamilyType.ByFamilyNameAndTypeName(familyName=code_block_6.out0, typeName=code_block_6.out1)
getLocation_3 = Element.GetLocation(element=all_elements_of_category_6)
byElementAndLocation = Orchid.RevitProject.Annotations.Tag.ByElementAndLocation(view=model_views_6, element=all_elements_of_category_6, tagType=byFamilyNameAndTypeName_6, location=getLocation_3)

watch_6 = Watch(byElementAndLocation)

# group: Area tagging
model_views_7 = ModelView(index=14)  # graph input
categories_7 = Categories(index=74)  # graph input
all_elements_of_category_7 = ElementsOfCategory(Category=categories_7)
code_block_7 = CodeBlock { "Area Tag"; "Text Only"; }
byFamilyNameAndTypeName_7 = FamilyType.ByFamilyNameAndTypeName(familyName=code_block_7.out0, typeName=code_block_7.out1)
bySpatialElement_3 = Orchid.RevitProject.Annotations.Tag.BySpatialElement(view=model_views_7, spatialElement=all_elements_of_category_7, tagType=byFamilyNameAndTypeName_7)

watch_7 = Watch(bySpatialElement_3)

# group: Area tagging by location
model_views_8 = ModelView(index=14)  # graph input
categories_8 = Categories(index=74)  # graph input
all_elements_of_category_8 = ElementsOfCategory(Category=categories_8)
code_block_8 = CodeBlock { "Area Tag"; "Text Only"; }
byFamilyNameAndTypeName_8 = FamilyType.ByFamilyNameAndTypeName(familyName=code_block_8.out0, typeName=code_block_8.out1)
getLocation_4 = Element.GetLocation(element=all_elements_of_category_8)
bySpatialElementAndLocation_3 = Orchid.RevitProject.Annotations.Tag.BySpatialElementAndLocation(view=model_views_8, spatialElement=all_elements_of_category_8, tagType=byFamilyNameAndTypeName_8, location=getLocation_4)

watch_8 = Watch(bySpatialElementAndLocation_3)
