# Dynamo graph Transfer-Copy.dyn (Dynamo 2.0.3.8810)

string = StringInput(".\")  # graph input
string_2 = StringInput("2019_defaultProject_extended")  # graph input
code_block = CodeBlock(a=string, b=string_2) { a+b+".rvt"; }
fromPath = Orchid.Common.File.FromPath(path=code_block)
backgroundOpen = Orchid.RevitProject.Common.Document.BackgroundOpen(file=fromPath)

# group: Copy Element
code_block_2 = CodeBlock(document=backgroundOpen) { document; }
categories = Categories(index=208)  # graph input
elementByCategory = Orchid.RevitProject.Elements.Selection.ElementByCategory(document=code_block_2, category=categories)
copyElement = Orchid.RevitProject.Common.Document.CopyElement(source=code_block_2, element=elementByCategory.Element)
watch = Watch(copyElement)
await_ = Orchid.Common.DataStream.Await(pass=code_block_2, waitFor=copyElement)

# group: Copy Schedule
code_block_3 = CodeBlock(document=backgroundOpen) { document; }
all = Orchid.RevitProject.Views.View.All(document=code_block_3)
string_from_object = FromObject(obj=all)
code_block_4 = CodeBlock { "Schedule"; }
contains = String.Contains(str=string_from_object, searchFor=code_block_4)
filterByBoolMask = List.FilterByBoolMask(list=all, mask=contains)
copySchedule = Orchid.RevitProject.Common.Document.CopySchedule(source=code_block_3, schedule=filterByBoolMask.in)
watch_2 = Watch(copySchedule)
await_2 = Orchid.Common.DataStream.Await(pass=code_block_3, waitFor=copySchedule)

# group: Copy Drafting View
code_block_5 = CodeBlock(document=backgroundOpen) { document; }
all_2 = Orchid.RevitProject.Views.View.All(document=code_block_5)
string_from_object_2 = FromObject(obj=all_2)
code_block_6 = CodeBlock { "Drafting"; }
contains_2 = String.Contains(str=string_from_object_2, searchFor=code_block_6)
filterByBoolMask_2 = List.FilterByBoolMask(list=all_2, mask=contains_2)
copyDraftingView = Orchid.RevitProject.Common.Document.CopyDraftingView(source=code_block_5, draftingView=filterByBoolMask_2.in)
watch_3 = Watch(copyDraftingView)
await_3 = Orchid.Common.DataStream.Await(pass=code_block_5, waitFor=copyDraftingView)

# group: Transfer Category
code_block_7 = CodeBlock(document=backgroundOpen) { document; }
categories_2 = Categories(index=408)  # graph input
boolean = BoolSelector(true)  # graph input
transferByCategory = Orchid.RevitProject.Common.Document.TransferByCategory(source=code_block_7, category=categories_2, append=boolean)
watch_4 = Watch(transferByCategory)
await_4 = Orchid.Common.DataStream.Await(pass=code_block_7, waitFor=transferByCategory)

# group: Transfer Type
code_block_8 = CodeBlock(document=backgroundOpen) { document; }
string_3 = StringInput("xExterior - 468mm Masonry / LW Concrete")  # graph input
string_4 = StringInput("x18x12M")  # graph input
create = List.Create(item0=string_3, item1=string_4)
boolean_2 = BoolSelector(true)  # graph input
transferByElementType = Orchid.RevitProject.Common.Document.TransferByElementType(source=code_block_8, elementType=create, append=boolean_2)
watch_5 = Watch(transferByElementType)
await_5 = Orchid.Common.DataStream.Await(pass=code_block_8, waitFor=transferByElementType)

# group: Transfer Family
code_block_9 = CodeBlock(document=backgroundOpen) { document; }
string_5 = StringInput("Single-Light")  # graph input
string_6 = StringInput("xSingle-Light")  # graph input
create_2 = List.Create(item0=string_5, item1=string_6)
boolean_3 = BoolSelector(true)  # graph input
transferByFamily = Orchid.RevitProject.Common.Document.TransferByFamily(source=code_block_9, family=create_2, append=boolean_3)
watch_6 = Watch(transferByFamily)
await_6 = Orchid.Common.DataStream.Await(pass=code_block_9, waitFor=transferByFamily)

# group: Close document
create_3 = List.Create(item0=await_3, item1=await_2, item2=await_, item3=await_4, item4=await_5, item5=await_6)
firstItem = List.FirstItem(list=create_3)
close = Orchid.RevitProject.Common.Document.Close(document=firstItem)
