# Dynamo graph Workset.dyn (Dynamo 2.6.1.8786)
# packages: Orchid 206.3.0.7975

# group: Selection
built_in_categories = CodeBlock()
# ---------- built_in_categories.designscript (26 lines) ----------
[
"OST_Casework",
"OST_Ceilings",
"OST_Columns",
"OST_CurtainWallMullions",
"OST_CurtainWallPanels",
"OST_CurtaSystem",
"OST_Doors",
"OST_Entourage",
"OST_Floors",
"OST_Furniture",
"OST_FurnitureSystems",
"OST_GenericModel",
"OST_PlumbingFixtures",
"OST_Ramps",
"OST_Roofs",
"OST_SpecialityEquipment",
"OST_Stairs",
"OST_StructuralColumns",
"OST_StructuralFoundation",
"OST_StructuralFraming",
"OST_StructuralFramingSystem",
"OST_StructuralStiffener",
"OST_Walls",
"OST_Windows"
];
# ----------------------------------------
natural_category_name = CodeBlock()
# ---------- natural_category_name.designscript (26 lines) ----------
[
"Casework",
"Ceilings",
"Columns",
"Curtain Wall Mullions",
"Curtain Panels",
"Curtain Systems",
"Doors",
"Entourage",
"Floors",
"Furniture",
"Furniture Systems",
"Generic Models",
"Plumbing Fixtures",
"Ramps",
"Roofs",
"Specialty Equipment",
"Stairs",
"Structural Columns",
"Structural Foundations",
"Structural Framing",
"Structural Beam Systems",
"Structural Stiffeners",
"Walls",
"Windows"
];
# ----------------------------------------
byName = Category.ByName(name=natural_category_name)
elementByCategory = Orchid.RevitProject.Elements.Selection.ElementByCategory(category=byName)
code_block = CodeBlock { "Workset Text"; }
getWorkset = Orchid.RevitProject.Elements.Element.GetWorkset(element=elementByCategory.Element)
name = Orchid.RevitProject.Common.Workset.Name(workset=getWorkset)
setParameterByName = Element.SetParameterByName(element=elementByCategory.Element, parameterName=code_block, value=name)

# group: Selection
code_block_2 = CodeBlock()
# ---------- code_block_2.designscript (9 lines) ----------
"Model";
"Annotation";
"AnalyticalModel";
"Internal";

["Model",
"Annotation",
"AnalyticalModel",
"Internal"];
# ----------------------------------------
elementByCategoryType = Orchid.RevitProject.Elements.Selection.ElementByCategoryType(categoryType=code_block_2.out0)
code_block_3 = CodeBlock { "Workset Text"; }
getWorkset_2 = Orchid.RevitProject.Elements.Element.GetWorkset(element=elementByCategoryType.Element)
name_2 = Orchid.RevitProject.Common.Workset.Name(workset=getWorkset_2)
setParameterByName_2 = Element.SetParameterByName(element=elementByCategoryType.Element, parameterName=code_block_3, value=name_2)

# group: Selection
elementHasMaterial = Orchid.RevitProject.Elements.Selection.ElementHasMaterial()
code_block_4 = CodeBlock { "Workset Text"; }
getWorkset_3 = Orchid.RevitProject.Elements.Element.GetWorkset(element=elementHasMaterial.Element)
name_3 = Orchid.RevitProject.Common.Workset.Name(workset=getWorkset_3)
setParameterByName_3 = Element.SetParameterByName(element=elementHasMaterial.Element, parameterName=code_block_4, value=name_3)

# group: Worksets
worksets = Workset("View \"3D View: {3D}\"")  # graph input
watch = Watch(worksets)
userWorksets = UserWorkset("Shell and Core")
watch_2 = Watch(userWorksets)

all = Orchid.RevitProject.Common.Workset.All()
code_block_5 = CodeBlock { "Walls"; }
byName_2 = Category.ByName(name=code_block_5)
all_elements_of_category = ElementsOfCategory(Category=byName_2)
code_block_6 = CodeBlock { "something"; }
create = Orchid.RevitProject.Common.Workset.Create(name=code_block_6)
await_ = Orchid.Common.DataStream.Await(pass=code_block_6, waitFor=create)
byName_3 = Orchid.RevitProject.Common.Workset.ByName(name=await_)
setWorkset = Orchid.RevitProject.Elements.Element.SetWorkset(element=all_elements_of_category, workset=byName_3)
getWorkset_4 = Orchid.RevitProject.Elements.Element.GetWorkset(element=all_elements_of_category)
watch_3 = Watch(getWorkset_4)
userWorkset = Orchid.RevitProject.Common.Workset.UserWorkset()
watch_4 = Watch(userWorkset)
name_4 = Orchid.RevitProject.Common.Workset.Name(workset=userWorkset)
byName_4 = Orchid.RevitProject.Common.Workset.ByName(name=name_4)
watch_5 = Watch(byName_4)
watch_6 = Watch(name_4)
id = Orchid.RevitProject.Common.Workset.Id(workset=userWorkset)
byId = Orchid.RevitProject.Common.Workset.ById(id=id)
watch_7 = Watch(byId)
uniqueId = Orchid.RevitProject.Common.Workset.UniqueId(workset=userWorkset)
watch_8 = Watch(uniqueId)
watch_9 = Watch(id)

# group: Convert to Orchid type
python_script = Python()  # graph input
# ---------- python_script.python (11 lines) ----------
# Common Language Runtime modules
import clr
clr.AddReference('RevitAPI')
clr.AddReference('RevitServices')

# Revit and Dynamo modules
from Autodesk.Revit.DB import FilteredWorksetCollector, WorksetKind
from RevitServices.Persistence import DocumentManager

doc = DocumentManager.Instance.CurrentDBDocument
OUT = FilteredWorksetCollector(doc).OfKind(WorksetKind.UserWorkset)
# ----------------------------------------
toOrchidType = Orchid.RevitProject.Common.Workset.ToOrchidType(workset=python_script)
name_5 = Orchid.RevitProject.Common.Workset.Name(workset=toOrchidType)
watch_10 = Watch(name_5)

# group: SetOwner and Relinquish
boolean = BoolSelector(true)
relinquish = Orchid.RevitProject.Elements.Element.Relinquish(waitFor=boolean)
watch_11 = Watch(relinquish)
userWorkset_2 = Orchid.RevitProject.Common.Workset.UserWorkset()
setOwner = Orchid.RevitProject.Common.Workset.SetOwner(workset=userWorkset_2)
relinquish_2 = Orchid.RevitProject.Common.Workset.Relinquish(waitFor=setOwner)
watch_12 = Watch(relinquish_2)
