# Dynamo graph AddSetGet.dyn (Dynamo 2.3.0.5885)
# packages: Orchid 203.3.0.7798

current = Orchid.RevitProject.Common.Document.Current()

# group: Utilities
code_block = CodeBlock()
# ---------- code_block.designscript (2 lines) ----------
//Types to create
"Type 1";
# ----------------------------------------
create = Orchid.RevitFamily.FamilyType.Create(familyDocument=current, name=code_block)

# group: Add parameter
await_ = Orchid.Common.DataStream.Await(pass=current, waitFor=create)
code_block_2 = CodeBlock()
# ---------- code_block_2.designscript (6 lines) ----------
//Parameter name
"Test2";
//Parameter type
"Number";
//Parameter group
"PG_ADSK_MODEL_PROPERTIES";
# ----------------------------------------
create_2 = Orchid.RevitFamily.Parameter.Create(familyDocument=await_, parameterName=code_block_2.out0, type=code_block_2.out1, group=code_block_2.out2)

# group: Set parameter
await_2 = Orchid.Common.DataStream.Await(pass=await_, waitFor=create_2)
code_block_3 = CodeBlock()
# ---------- code_block_3.designscript (6 lines) ----------
//Type
"Type 1";
//Parameter name
"Test2";
//Value
1.5;
# ----------------------------------------
setValue = Orchid.RevitFamily.Parameter.SetValue(familyDocument=await_2, familyType=code_block_3.out0, parameterName=code_block_3.out1, value=code_block_3.out2)

# group: Add parameter
await_3 = Orchid.Common.DataStream.Await(pass=current, waitFor=create)
code_block_4 = CodeBlock()
# ---------- code_block_4.designscript (14 lines) ----------
//Parameter name
"Test1";
//Parameter type
"Integer";
//Parameter group
"PG_ADSK_MODEL_PROPERTIES";
//ToolTip
"do this work?";
//Instances
true;
//Reporting
true;
//Condense output
false;
# ----------------------------------------
create_3 = Orchid.RevitFamily.Parameter.Create(familyDocument=await_3, parameterName=code_block_4.out0, type=code_block_4.out1, group=code_block_4.out2, tooltip=code_block_4.out3)

# group: Set parameter
await_4 = Orchid.Common.DataStream.Await(pass=await_3, waitFor=create_3)
code_block_5 = CodeBlock()
# ---------- code_block_5.designscript (6 lines) ----------
//Type
"Type 1";
//Parameter name
"Test1";
//Value
1;
# ----------------------------------------
setValue_2 = Orchid.RevitFamily.Parameter.SetValue(familyDocument=await_4, familyType=code_block_5.out0, parameterName=code_block_5.out1, value=code_block_5.out2)

# group: Add parameter
await_5 = Orchid.Common.DataStream.Await(pass=current, waitFor=create)
code_block_6 = CodeBlock()
# ---------- code_block_6.designscript (6 lines) ----------
//Parameter name
"Test3";
//Parameter type
"Text";
//Parameter group
"PG_ADSK_MODEL_PROPERTIES";
# ----------------------------------------
create_4 = Orchid.RevitFamily.Parameter.Create(familyDocument=await_5, parameterName=code_block_6.out0, type=code_block_6.out1, group=code_block_6.out2)

# group: Set parameter
await_6 = Orchid.Common.DataStream.Await(pass=await_5, waitFor=create_4)
code_block_7 = CodeBlock()
# ---------- code_block_7.designscript (6 lines) ----------
//Type
"Type 1";
//Parameter name
"Test3";
//Value
"string";
# ----------------------------------------
setValue_3 = Orchid.RevitFamily.Parameter.SetValue(familyDocument=await_6, familyType=code_block_7.out0, parameterName=code_block_7.out1, value=code_block_7.out2)

# group: Add parameter
await_7 = Orchid.Common.DataStream.Await(pass=current, waitFor=create)
code_block_8 = CodeBlock()
# ---------- code_block_8.designscript (6 lines) ----------
//Parameter name
"Test4";
//Parameter type
"Material";
//Parameter group
"PG_ADSK_MODEL_PROPERTIES";
# ----------------------------------------
create_5 = Orchid.RevitFamily.Parameter.Create(familyDocument=await_7, parameterName=code_block_8.out0, type=code_block_8.out1, group=code_block_8.out2)

# group: Set parameter
await_8 = Orchid.Common.DataStream.Await(pass=await_7, waitFor=create_5)
code_block_9 = CodeBlock()
# ---------- code_block_9.designscript (4 lines) ----------
//Type
"Type 1";
//Parameter name
"Test4";
# ----------------------------------------
code_block_10 = CodeBlock { "Glass"; }
byName = Material.ByName(name=code_block_10)
setValue_4 = Orchid.RevitFamily.Parameter.SetValue(familyDocument=await_8, familyType=code_block_9.out0, parameterName=code_block_9.out1, value=byName)

create_6 = List.Create(item0=setValue_2, item1=setValue, item2=setValue_3, item3=setValue_4)

# group: Parameters
await_9 = Orchid.Common.DataStream.Await(pass=await_2, waitFor=create_6)
parameters = Orchid.RevitFamily.Document.Parameters(familyDocument=await_9)
name = Orchid.RevitFamily.Parameter.Name(parameter=parameters)
watch = Watch(name)

# group: Get Parameter
await_10 = Orchid.Common.DataStream.Await(pass=await_2, waitFor=create_6)
code_block_11 = CodeBlock()
# ---------- code_block_11.designscript (7 lines) ----------
//Type name
"Type 1";
//Parameter name
["Test1",
"Test2",
"Test3",
"Test4"];
# ----------------------------------------
byName_2 = Orchid.RevitFamily.FamilyType.ByName(name=code_block_11.out0)
getValue = Orchid.RevitFamily.Parameter.GetValue(familyDocument=await_10, familyType=byName_2, parameterName=code_block_11.out1)
watch_2 = Watch(getValue.valueByParameter)
type = Object.Type(obj=getValue.valueByParameter)
watch_3 = Watch(type)
code_block_12 = CodeBlock(t=getValue.valueByParameter) { t[3]; }
name_2 = Material.Name(material=code_block_12)
watch_4 = Watch(name_2)

# group: Convert to Orchid type
python_script = Python(IN[0]=create_6)
# ---------- python_script.python (12 lines) ----------
# Common Language Runtime modules
import clr
clr.AddReference('RevitAPI')
clr.AddReference('RevitServices')

# Revit and Dynamo modules
from Autodesk.Revit.DB import Family
from RevitServices.Persistence import DocumentManager

dummy = IN[0]
doc = DocumentManager.Instance.CurrentDBDocument
OUT = doc.FamilyManager.Parameters
# ----------------------------------------
toOrchidType = Orchid.RevitFamily.Parameter.ToOrchidType(parameter=python_script)
name_3 = Orchid.RevitFamily.Parameter.Name(parameter=toOrchidType)
watch_5 = Watch(name_3)

# group: Filter by Type
code_block_13 = CodeBlock(data=setValue_4) { data; }
type_2 = Object.Type(obj=code_block_13)
toType = Orchid.Common.String.ToType(string=type_2)
typeOf = Orchid.Common.Object.TypeOf(object=code_block_13, type=toType)
watch_6 = Watch(typeOf)

type_3 = Object.Type(obj=parameters)
