# Dynamo graph CategoryReporting.dyn (Dynamo 2.3.0.5885)
# packages: Orchid 203.3.0.7798

current = Orchid.RevitProject.Common.Document.Current()

# group: Set the document category
code_block = CodeBlock { "Casework"; }
byName = Category.ByName(name=code_block)
setCategory = Orchid.RevitFamily.Document.SetCategory(familyDocument=current, category=byName)

# group: Get the document category
await_ = Orchid.Common.DataStream.Await(pass=current, waitFor=setCategory)
getCategory = Orchid.RevitFamily.Document.GetCategory(familyDocument=await_)

# group: Create types
code_block_2 = CodeBlock()
# ---------- code_block_2.designscript (2 lines) ----------
//Types to create
["Type 1", "Type 2"];
# ----------------------------------------
create = Orchid.RevitFamily.FamilyType.Create(familyDocument=current, name=code_block_2)

# group: Add parameter
await_2 = Orchid.Common.DataStream.Await(pass=current, waitFor=create)
code_block_3 = CodeBlock()
# ---------- code_block_3.designscript (8 lines) ----------
//Parameter name
"dim";
//Parameter type
"Length";
//Parameter group
"PG_ADSK_MODEL_PROPERTIES";
//Reporting
true;
# ----------------------------------------
create_2 = Orchid.RevitFamily.Parameter.Create(familyDocument=await_2, parameterName=code_block_3.out0, type=code_block_3.out1, group=code_block_3.out2, reporting=code_block_3.out3)

# group: Parameters
parameters = Orchid.RevitFamily.Document.Parameters(familyDocument=await_2)
name = Orchid.RevitFamily.Parameter.Name(parameter=parameters)

watch = Watch(name)

# group: Add parameter
await_3 = Orchid.Common.DataStream.Await(pass=current, waitFor=create)
code_block_4 = CodeBlock()
# ---------- code_block_4.designscript (10 lines) ----------
//Parameter name
"Test";
//Parameter type
"Text";
//Parameter group
"PG_ADSK_MODEL_PROPERTIES";
//Tooltip
"Owner value";
//Instances
true;
# ----------------------------------------
create_3 = Orchid.RevitFamily.Parameter.Create(familyDocument=await_3, parameterName=code_block_4.out0, type=code_block_4.out1, group=code_block_4.out2, tooltip=code_block_4.out3, instance=code_block_4.out4)

# group: Set parameter
await_4 = Orchid.Common.DataStream.Await(pass=await_3, waitFor=create_3)
code_block_5 = CodeBlock()
# ---------- code_block_5.designscript (6 lines) ----------
//Type
"Type 1";
//Parameter name
"Test";
//Value
"This is a test";
# ----------------------------------------
setValue = Orchid.RevitFamily.Parameter.SetValue(familyDocument=await_4, familyType=code_block_5.out0, parameterName=code_block_5.out1, value=code_block_5.out2)

create_4 = List.Create(item0=create_2, item1=create_3)

# group: IsReporting parameter
name_2 = Orchid.RevitFamily.Parameter.Name(parameter=create_4)
isReporting = Orchid.RevitFamily.Parameter.IsReporting(familyDocument=await_2, parameterName=name_2)

watch_2 = Watch(isReporting)
watch_3 = Watch(name_2)
