# Dynamo graph Collect families in project.dyn (Dynamo 2.0.3.8810)

# group: Open all files in directory and sub directories
string = StringInput("..\testSet")  # graph input
code_block = CodeBlock { "*.rfa"; true; }
contents = Orchid.Common.Directory.Contents(directory=string, searchString=code_block.out0)  # frozen
backgroundOpen = Orchid.RevitProject.Common.Document.BackgroundOpen(file=contents)

# group: Close files
await_ = Orchid.Common.DataStream.Await()  # unwired: pass, waitFor
boolean = BoolSelector(true)  # graph input
close = Orchid.RevitProject.Common.Document.Close(document=await_, save=boolean)  # frozen

# group: Collect family as document from current document
code_block_2 = CodeBlock { ["Doors","Windows"]; }
elementByCategory = Orchid.RevitProject.Elements.Selection.ElementByCategory(category=code_block_2)
elementType = Element.ElementType(element=elementByCategory.Element)
uniqueItems = List.UniqueItems(list=elementType, lacing=Longest)
flatten = List.Flatten(list=uniqueItems)
family = FamilyType.Family(familyType=flatten)

uniqueItems_2 = List.UniqueItems(list=family)

# group (continued): Collect family as document from current document
edit = Orchid.RevitProject.Elements.Family.Edit(family=uniqueItems_2)

code_block_3 = CodeBlock()
# ---------- code_block_3.designscript (12 lines) ----------
//Parameter name
"Creator Build";
//SP Parameter group
"Sheet & Project";
//SP Parameter type
"Text";
//Parameter group
"PG_ADSK_MODEL_PROPERTIES";
//Instances
true;
//Reporting
false;
# ----------------------------------------
add = Orchid.RevitFamily.SharedParameter.Add(familyDocument=edit, parameterName=code_block_3.out0, groupName=code_block_3.out1, type=code_block_3.out2, group=code_block_3.out3, instance=code_block_3.out4)

# group: load back into the current project
await_2 = Orchid.Common.DataStream.Await(pass=edit, waitFor=add)
load = Orchid.RevitProject.Elements.Family.Load(family=await_2)
await_3 = Orchid.Common.DataStream.Await(pass=await_2, waitFor=load)
close_2 = Orchid.RevitProject.Common.Document.Close(document=await_3)
