# Dynamo graph FamilyType.dyn (Dynamo 2.3.0.5885)
# packages: Orchid 203.3.0.7798

current = Orchid.RevitProject.Common.Document.Current()

# group: Add parameter
code_block = CodeBlock()
# ---------- code_block.designscript (15 lines) ----------
//Parameter name
["Test","something"];
//Parameter type
"Text";
//"Length";
//Parameter group
"PG_ADSK_MODEL_PROPERTIES";
//Tooltip
"Owner value";
//Instances
true;
//Reporting
true;
//Condense output
false;
# ----------------------------------------
create = Orchid.RevitFamily.Parameter.Create(familyDocument=current, parameterName=code_block.out0, type=code_block.out1, group=code_block.out2)

# group: Rename parameter
await_ = Orchid.Common.DataStream.Await(pass=current, waitFor=create)
code_block_2 = CodeBlock()
# ---------- code_block_2.designscript (4 lines) ----------
//Source name
"Test";
//Target name
"NewTest";
# ----------------------------------------
rename = Orchid.RevitFamily.Parameter.Rename(familyDocument=await_, sourceName=code_block_2.out0, targetName=code_block_2.out1)

# group: Delete parameter
await_2 = Orchid.Common.DataStream.Await(pass=await_, waitFor=rename)
code_block_3 = CodeBlock()
# ---------- code_block_3.designscript (2 lines) ----------
//Parameter name
"NewTest";
# ----------------------------------------
delete = Orchid.RevitFamily.Parameter.Delete(familyDocument=await_2, parameterName=code_block_3)

# group: Create type
code_block_4 = CodeBlock()
# ---------- code_block_4.designscript (2 lines) ----------
//Types to create
["Type 1", "Type 2"];
# ----------------------------------------
create_2 = Orchid.RevitFamily.FamilyType.Create(familyDocument=current, name=code_block_4)

# group: Rename type
await_3 = Orchid.Common.DataStream.Await(pass=current, waitFor=create_2)
code_block_5 = CodeBlock()
# ---------- code_block_5.designscript (4 lines) ----------
//Source name
"Type 1";
//Target name
"Type 3";
# ----------------------------------------
rename_2 = Orchid.RevitFamily.FamilyType.Rename(familyDocument=await_3, sourceName=code_block_5.out0, targetName=code_block_5.out1)

# group: Delete type
code_block_6 = CodeBlock()
# ---------- code_block_6.designscript (2 lines) ----------
//Type name
"Type 3";
# ----------------------------------------
await_4 = Orchid.Common.DataStream.Await(pass=await_3, waitFor=rename_2)
name = Orchid.RevitFamily.FamilyType.Name(familyType=rename_2)
byName = Orchid.RevitFamily.FamilyType.ByName(name=name)
delete_2 = Orchid.RevitFamily.FamilyType.Delete(familyDocument=await_4, familyType=byName)

# group: Get all family type
# note: This node is being processed among the first, while it always look at the current document and don't need a document to be loaded. Therefore, run the graph twice if you greate/delete types in the graph! This node is best to use in families where types are not added!
all = Orchid.RevitFamily.FamilyType.All()
name_2 = Orchid.RevitFamily.FamilyType.Name(familyType=all)
watch = Watch(name_2)
watch_2 = Watch(all)

# group: Convert to Orchid type
python_script = Python(IN[0]=create_2)
# ---------- python_script.python (12 lines) ----------
# Common Language Runtime modules
import clr
clr.AddReference('RevitAPI')
clr.AddReference('RevitServices')

# Revit and Dynamo modules
from Autodesk.Revit.DB import Family
from RevitServices.Persistence import DocumentManager

dummy = IN[0]
doc = DocumentManager.Instance.CurrentDBDocument
OUT = doc.FamilyManager.Types
# ----------------------------------------
toOrchidType = Orchid.RevitFamily.FamilyType.ToOrchidType(familyType=python_script)
name_3 = Orchid.RevitFamily.FamilyType.Name(familyType=toOrchidType)
watch_3 = Watch(name_3)

# group: Current family type
# note: This node is being processed among the first, while it always look at the current document and don't need a document to be loaded. Therefore, run the graph twice if you greate/delete types in the graph! This node is best to use in families where types are not added!
current_2 = Orchid.RevitFamily.FamilyType.Current()
name_4 = Orchid.RevitFamily.FamilyType.Name(familyType=current_2)
watch_4 = Watch(name_4)

# group: Get all family type by document
await_5 = Orchid.Common.DataStream.Await(pass=current, waitFor=create_2)
all_2 = Orchid.RevitFamily.FamilyType.All(familyDocument=await_5)
name_5 = Orchid.RevitFamily.FamilyType.Name(familyType=all_2)
watch_5 = Watch(name_5)

watch_6 = Watch(rename)
