# Dynamo graph FormSetGet.dyn (Dynamo 2.3.0.5885)
# packages: Orchid 203.3.0.7798

# group: Create ordinary parameter
current = Orchid.RevitProject.Common.Document.Current()
code_block = CodeBlock()
# ---------- code_block.designscript (6 lines) ----------
//Parameter name
"Material";
//Parameter type
"Material";
//Parameter group
"PG_ADSK_MODEL_PROPERTIES";
# ----------------------------------------
create = Orchid.RevitFamily.Parameter.Create(familyDocument=current, parameterName=code_block.out0, type=code_block.out1, group=code_block.out2)

# group: Set parameter
await_ = Orchid.Common.DataStream.Await(pass=current, waitFor=create)
code_block_2 = CodeBlock()
# ---------- code_block_2.designscript (2 lines) ----------
//Parameter name
"Material";
# ----------------------------------------
material = Material("Glass")  # graph input
setValue = Orchid.RevitFamily.Parameter.SetValue(familyDocument=await_, parameterName=code_block_2, value=material)

# group: Select geometry
element_types = ElementTypes("Extrusion")  # graph input
all_elements_of_type = ElementsOfType(element_type=element_types)

# group: Associate parameter
await_2 = Orchid.Common.DataStream.Await(pass=await_, waitFor=setValue)
code_block_3 = CodeBlock()  # same code as code_block_2
associate = Orchid.RevitFamily.Parameter.Associate(familyDocument=await_2, parameterName=code_block_3, element=all_elements_of_type, elementParameter=code_block_3)
