# Dynamo graph Nested-Lookup.dyn (Dynamo 2.3.0.5885)
# packages: Orchid 203.3.0.7798

# group: Load a family (nested)
string = StringInput("..\testSet\Front - Plain.rfa")  # graph input
backgroundOpen = Orchid.RevitProject.Common.Document.BackgroundOpen(file=string)
load = Orchid.RevitProject.Elements.Family.Load(family=backgroundOpen)
await_ = Orchid.Common.DataStream.Await(pass=backgroundOpen, waitFor=load)
close = Orchid.RevitProject.Common.Document.Close(document=await_)

# group: create default family type
current = Orchid.RevitProject.Common.Document.Current()
create = Orchid.RevitFamily.FamilyType.Create(familyDocument=current)
await_2 = Orchid.Common.DataStream.Await(pass=current, waitFor=create)

# group: Create ordinary parameter
code_block = CodeBlock()
# ---------- code_block.designscript (6 lines) ----------
//Parameter name
["Width","Height","testValue"];
//Parameter type
"Length";
//Parameter group
"PG_ADSK_MODEL_PROPERTIES";
# ----------------------------------------
create_2 = Orchid.RevitFamily.Parameter.Create(familyDocument=await_2, parameterName=code_block.out0, type=code_block.out1, group=code_block.out2)

# group: Create ordinary parameter
code_block_2 = CodeBlock()
# ---------- code_block_2.designscript (6 lines) ----------
//Parameter name
["Lookup Table Name","testKey"];
//Parameter type
"Text";
//Parameter group
"PG_ADSK_MODEL_PROPERTIES";
# ----------------------------------------
create_3 = Orchid.RevitFamily.Parameter.Create(familyDocument=await_2, parameterName=code_block_2.out0, type=code_block_2.out1, group=code_block_2.out2)

# group: Set parameter
create_4 = List.Create(item0=create_2, item1=create_3)
await_3 = Orchid.Common.DataStream.Await(pass=await_2, waitFor=create_4)
code_block_3 = CodeBlock()
# ---------- code_block_3.designscript (4 lines) ----------
//Parameter name
["Lookup Table Name","testKey"];
//Values
["CSVLookuptable","11x300"];
# ----------------------------------------
setValue = Orchid.RevitFamily.Parameter.SetValue(familyDocument=await_3, parameterName=code_block_3.out0, value=code_block_3.out1)

# group: Add lookup table and use it by setting a formula
await_4 = Orchid.Common.DataStream.Await(pass=await_3, waitFor=setValue)
string_2 = StringInput("..\CSVLookuptable.csv")  # graph input
addLookupTable = Orchid.RevitFamily.Document.AddLookupTable(familyDocument=await_4, file=string_2)
await_5 = Orchid.Common.DataStream.Await(pass=await_4, waitFor=addLookupTable)
code_block_4 = CodeBlock()
# ---------- code_block_4.designscript (4 lines) ----------
//Parameter name
"testValue";
//Values
["size_lookup(Lookup Table Name, \"d\", 0, testKey)"];
# ----------------------------------------
string_3 = StringInput("size_lookup(Lookup Table Name, \"d\", 0, testKey)")  # graph input
set = Orchid.RevitFamily.Formula.Set(familyDocument=await_5, parameterName=code_block_4.out0, value=string_3)

# group: Set parameter
await_6 = Orchid.Common.DataStream.Await(pass=await_2, waitFor=create_2)
code_block_5 = CodeBlock()
# ---------- code_block_5.designscript (4 lines) ----------
//Parameter name
"Width";
//Value
800.0;
# ----------------------------------------
setValue_2 = Orchid.RevitFamily.Parameter.SetValue(familyDocument=await_6, parameterName=code_block_5.out0, value=code_block_5.out1)

types = Family.Types(family=load)

# group: Associate parameter
await_7 = Orchid.Common.DataStream.Await(pass=await_6, waitFor=setValue_2)
code_block_6 = CodeBlock()
# ---------- code_block_6.designscript (2 lines) ----------
//Parameter name
"Width";
# ----------------------------------------
associate = Orchid.RevitFamily.Parameter.Associate(familyDocument=await_7, parameterName=code_block_6, element=types, elementParameter=code_block_6)
await_8 = Orchid.Common.DataStream.Await(pass=await_7, waitFor=associate)

# group: Get nested family and converters
getNested = Orchid.RevitFamily.Family.GetNested(familyDocument=await_8)
watch = Watch(getNested)
toRevitType = Orchid.RevitProject.Elements.Element.ToRevitType(element=getNested)
watch_2 = Watch(toRevitType)
toDynamoType = Orchid.RevitProject.Elements.Element.ToDynamoType(element=toRevitType)
watch_3 = Watch(toDynamoType)
name = Element.Name(element=toDynamoType)
watch_4 = Watch(name)

# group: Get nested family type (FamilySymbol) and converters Note: Nested families in a family document is denoted FamilySymbol in the Autodesk Revit API! FamilyType in a project document is also denoted FamilySymbol in the Autodesk Revit API!
getNested_2 = Orchid.RevitFamily.FamilyType.GetNested(familyDocument=await_8)
watch_5 = Watch(getNested_2)
toRevitType_2 = Orchid.RevitProject.Elements.Element.ToRevitType(element=getNested_2)
toDynamoType_2 = Orchid.RevitProject.Elements.Element.ToDynamoType(element=toRevitType_2)
watch_6 = Watch(toDynamoType_2)
name_2 = Element.Name(element=toDynamoType_2)
watch_7 = Watch(name_2)
watch_8 = Watch(toRevitType_2)

# group: Get nested data --> use OOTB nodes inside family document
lastItem = List.LastItem(list=getNested_2)
code_block_7 = CodeBlock()
# ---------- code_block_7.designscript (2 lines) ----------
//Parameter name
["Width"];
# ----------------------------------------
getParameterValueByName = Element.GetParameterValueByName(element=lastItem, parameterName=code_block_7)
watch_9 = Watch(getParameterValueByName)

# group: Create Family Type parameter (Category)
code_block_8 = CodeBlock()
# ---------- code_block_8.designscript (8 lines) ----------
//Parameter name
["testFamily"];
//Parameter group
"PG_ADSK_MODEL_PROPERTIES";
//Instances
true;
//Reporting
true;
# ----------------------------------------
code_block_9 = CodeBlock { Revit.Category.ByName("Casework"); }
create_5 = Orchid.RevitFamily.Parameter.Create(familyDocument=await_2, parameterName=code_block_8.out0, category=code_block_9, group=code_block_8.out1)

# group: Has the parameter associated element
code_block_10 = CodeBlock()
# ---------- code_block_10.designscript (2 lines) ----------
//Parameter name
["Width","Height"];
# ----------------------------------------
hasAssociated = Orchid.RevitFamily.Parameter.HasAssociated(familyDocument=await_8, parameterName=code_block_10)
watch_10 = Watch(hasAssociated)

# group: Get associated element and parameter
getAssociated = Orchid.RevitFamily.Document.GetAssociated(familyDocument=await_8)
watch_11 = Watch(getAssociated.Parameter)
watch_12 = Watch(getAssociated.Element)
watch_13 = Watch(getAssociated.elementParameter)
code_block_11 = CodeBlock()  # same code as code_block_6
getAssociated_2 = Orchid.RevitFamily.Parameter.GetAssociated(familyDocument=await_8, parameterName=code_block_11)
watch_14 = Watch(getAssociated_2.Element)
watch_15 = Watch(getAssociated_2.elementParameter)

# group: parameters
parameters = Orchid.RevitFamily.Document.Parameters(familyDocument=await_8)
name_3 = Orchid.RevitFamily.Parameter.Name(parameter=parameters)
watch_16 = Watch(name_3)
