# Dynamo graph SetGet.dyn (Dynamo 2.3.0.5885)
# packages: Orchid 203.3.0.7798

directory_path = StringInput("..\testSet")  # graph input
string = StringInput("*.rfa")  # graph input
boolean = BoolSelector(false)  # graph input
contents = Orchid.Common.Directory.Contents(directory=directory_path, searchString=string, deepSearch=boolean)
backgroundOpen = Orchid.RevitProject.Common.Document.BackgroundOpen(file=contents)
create = Orchid.RevitFamily.FamilyType.Create(familyDocument=backgroundOpen)
await_ = Orchid.Common.DataStream.Await(pass=backgroundOpen, waitFor=create)
all = Orchid.RevitFamily.FamilyType.All(familyDocument=await_)
code_block = CodeBlock()
# ---------- code_block.designscript (4 lines) ----------
//parameter name
["Model", "Description"];
//value
["Testing1", "Testing2"];
# ----------------------------------------
setValue = Orchid.RevitFamily.Parameter.SetValue(familyDocument=await_, familyType=all, parameterName=code_block.out0, value=code_block.out1)
await_2 = Orchid.Common.DataStream.Await(pass=await_, waitFor=setValue)
getValue = Orchid.RevitFamily.Parameter.GetValue(familyDocument=await_2, familyType=all, parameterName=code_block.out0)
await_3 = Orchid.Common.DataStream.Await(pass=await_2, waitFor=getValue.valueByType)
boolean_2 = BoolSelector(true)  # graph input
close = Orchid.RevitProject.Common.Document.Close(document=await_3, save=boolean_2)

# group: Cleanup backup files
await_4 = Orchid.Common.DataStream.Await(pass=directory_path, waitFor=close)
string_2 = StringInput("*.0001.rfa")  # graph input
boolean_3 = BoolSelector(true)  # graph input
contents_2 = Orchid.Common.Directory.Contents(directory=await_4, searchString=string_2, deepSearch=boolean_3)
deleteFile = FileSystem.DeleteFile(path=contents_2)

code_block_2 = CodeBlock()
# ---------- code_block_2.designscript (4 lines) ----------
//parameter name
"Model";
//value
"Testing";
# ----------------------------------------
current = Orchid.RevitFamily.FamilyType.Current()  # frozen
all_2 = Orchid.RevitFamily.FamilyType.All()  # frozen
name = Orchid.RevitFamily.FamilyType.Name(familyType=all)
watch = Watch(getValue.valueByType)
watch_2 = Watch(getValue.valueByParameter)
name_2 = Orchid.RevitFamily.Parameter.Name(parameter=setValue)
