# Dynamo graph SharedParameter.dyn (Dynamo 2.3.0.5885)
# packages: Orchid 203.3.0.7798

# group: Add shared parameters by groupName by provided file
string = StringInput("..\COBie Extension Shared Parameters.txt")  # graph input
code_block = CodeBlock()
# ---------- code_block.designscript (15 lines) ----------
//SP Parameter group
["Floor","Type"];
//Parameter group
["INVALID",
"PG_ADSK_MODEL_PROPERTIES"];
//Instance
[true,false];
//Reporting
//NOTE: this list must follow the order
//of true values in the "Instance" list.
//This list does not have to have same
//length as the above three lists!
[true];
//Condense output
false;
# ----------------------------------------
addByFile = Orchid.RevitFamily.SharedParameter.AddByFile(file=string, groupName=code_block.out0, group=code_block.out1, instance=code_block.out2)
name = Orchid.RevitFamily.Parameter.Name(parameter=addByFile.Parameter)
watch = Watch(name)
watch_2 = Watch(addByFile.GroupName)

# group: Add IFC parameters
addIFC = Orchid.RevitFamily.SharedParameter.AddIFC()
name_2 = Orchid.RevitFamily.Parameter.Name(parameter=addIFC)
watch_3 = Watch(name_2)

# group: Add BIM7AA parameters
addBIM7AA = Orchid.RevitFamily.SharedParameter.AddBIM7AA()
name_3 = Orchid.RevitFamily.Parameter.Name(parameter=addBIM7AA)
watch_4 = Watch(name_3)

# group: Add shared parameters by groupName (current loaded)
code_block_2 = CodeBlock()
# ---------- code_block_2.designscript (15 lines) ----------
//SP Parameter group
["Energy","Dimensions"];
//Parameter group
["PG_ENERGY_ANALYSIS",
"PG_GEOMETRY"];
//Instance
[true,false];
//Reporting
//NOTE: this list must follow the order
//of true values in the "Instance" list.
//This list does not have to have same
//length as the above three lists!
[true];
//Condense output
false;
# ----------------------------------------
addByGroup = Orchid.RevitFamily.SharedParameter.AddByGroup(groupName=code_block_2.out0, group=code_block_2.out1, instance=code_block_2.out2)
name_4 = Orchid.RevitFamily.Parameter.Name(parameter=addByGroup.Parameter)
watch_5 = Watch(name_4)
watch_6 = Watch(addByGroup.GroupName)

# group: Add CCS parameters
addCCS = Orchid.RevitFamily.SharedParameter.AddCCS()
name_5 = Orchid.RevitFamily.Parameter.Name(parameter=addCCS)
watch_7 = Watch(name_5)
