# Dynamo graph Graphics.dyn (Dynamo 2.0.3.8810)

# group: Create, Set Render Appearance, SetShadingColor, Set Transparency, Set Surface Pattern, Set Surface Pattern Color, Set Cut Pattern, Set Cut Pattern Color --> For Revit 2019
code_block = CodeBlock { "_test3"; }
create = Orchid.RevitMaterial.Material.Create(name=code_block)
fill_patterns = FillPatterns(index=31)  # graph input
setSurfaceForegroundPattern = Orchid.RevitMaterial.Graphics.SetSurfaceForegroundPattern(material=create, pattern=fill_patterns)
code_block_2 = CodeBlock { DSCore.Color.ByARGB(255,145,185,165); }
setSurfaceForegroundPatternColor = Orchid.RevitMaterial.Graphics.SetSurfaceForegroundPatternColor(material=setSurfaceForegroundPattern, color=code_block_2)
getCutForegroundPattern = Orchid.RevitMaterial.Graphics.GetCutForegroundPattern(material=setSurfaceForegroundPatternColor)
watch = Watch(getCutForegroundPattern)
name = Material.Name(material=create)
watch_2 = Watch(name)
code_block_3 = CodeBlock { DSCore.Color.ByARGB(255,25,60,30); }
setShadingColor = Orchid.RevitMaterial.Graphics.SetShadingColor(material=create, color=code_block_3)
getShadingColor = Orchid.RevitMaterial.Graphics.GetShadingColor(material=setShadingColor)
watch_3 = Watch(getShadingColor)
code_block_4 = CodeBlock { 75; }
setTransparency = Orchid.RevitMaterial.Graphics.SetTransparency(material=create, transparency=code_block_4)
getTransparency = Orchid.RevitMaterial.Graphics.GetTransparency(material=setTransparency)
watch_4 = Watch(getTransparency)
watch_5 = Watch(create)
setCutForegroundPattern = Orchid.RevitMaterial.Graphics.SetCutForegroundPattern(material=create, pattern=fill_patterns)
setCutForegroundPatternColor = Orchid.RevitMaterial.Graphics.SetCutForegroundPatternColor(material=setCutForegroundPattern, color=code_block_2)
getCutForegroundPatternColor = Orchid.RevitMaterial.Graphics.GetCutForegroundPatternColor(material=setCutForegroundPatternColor)
watch_6 = Watch(getCutForegroundPatternColor)
fill_patterns_2 = FillPatterns(index=36)  # graph input
setCutBackgroundPattern = Orchid.RevitMaterial.Graphics.SetCutBackgroundPattern(material=create, pattern=fill_patterns_2)
code_block_5 = CodeBlock { 55; 125; 85; }
byARGB = Color.ByARGB(r=code_block_5.out0, g=code_block_5.out1, b=code_block_5.out2)
setCutBackgroundPatternColor = Orchid.RevitMaterial.Graphics.SetCutBackgroundPatternColor(material=setCutBackgroundPattern, color=byARGB)
getCutBackgroundPatternColor = Orchid.RevitMaterial.Graphics.GetCutBackgroundPatternColor(material=setCutBackgroundPatternColor)
watch_7 = Watch(getCutBackgroundPatternColor)
setSurfaceBackgroundPattern = Orchid.RevitMaterial.Graphics.SetSurfaceBackgroundPattern(material=create, pattern=fill_patterns_2)
setSurfaceBackgroundPatternColor = Orchid.RevitMaterial.Graphics.SetSurfaceBackgroundPatternColor(material=setSurfaceBackgroundPattern, color=byARGB)
getCutBackgroundPattern = Orchid.RevitMaterial.Graphics.GetCutBackgroundPattern(material=setSurfaceBackgroundPatternColor)
watch_8 = Watch(getCutBackgroundPattern)
boolean = BoolSelector(false)  # graph input
setRenderAppearance = Orchid.RevitMaterial.Graphics.SetRenderAppearance(material=create, useRenderAppearance=boolean)
getRenderAppearance = Orchid.RevitMaterial.Graphics.GetRenderAppearance(material=setRenderAppearance)
watch_9 = Watch(getRenderAppearance)
watch_10 = Watch(setCutBackgroundPattern)
watch_11 = Watch(setSurfaceBackgroundPattern)
watch_12 = Watch(setSurfaceForegroundPattern)
watch_13 = Watch(setCutForegroundPattern)

# group: Create, Get --> For Revit 2019
code_block_6 = CodeBlock { "_test2"; }
create_2 = Orchid.RevitMaterial.Material.Create(name=code_block_6)
watch_14 = Watch(create_2)
boolean_2 = BoolSelector(false)  # graph input
code_block_7 = CodeBlock { DSCore.Color.ByARGB(255,25,60,30); 50; }
fill_patterns_3 = FillPatterns(index=41)  # graph input
code_block_8 = CodeBlock { 45; 85; 65; }
byARGB_2 = Color.ByARGB(r=code_block_8.out0, g=code_block_8.out1, b=code_block_8.out2)
set = Orchid.RevitMaterial.Graphics.Set(material=create_2, useRenderAppearance=boolean_2, shadingColor=code_block_7.out0, transparency=code_block_7.out1, surfaceForegroundPattern=fill_patterns_3, surfaceForegroundPatternColor=byARGB_2, cutBackgroundPattern=fill_patterns_3, cutBackgroundPatternColor=byARGB_2)
get = Orchid.RevitMaterial.Graphics.Get(material=set)
watch_15 = Watch(get.UseRenderAppearance)
watch_16 = Watch(get.ShadingColor)
watch_17 = Watch(get.Transparency)
watch_18 = Watch(get.surfaceForegroundPattern)
watch_19 = Watch(get.surfaceForegroundPatternColor)
watch_20 = Watch(get.surfaceBackgroundPattern)
name_2 = Material.Name(material=create_2)
watch_21 = Watch(name_2)
watch_22 = Watch(get.surfaceBackgroundPatternColor)
watch_23 = Watch(get.cutBackgroundPattern)
watch_24 = Watch(get.cutBackgroundPatternColor)
watch_25 = Watch(get.cutForegroundPatternColor)
watch_26 = Watch(get.cutForegroundPattern)

# group: Smoothness, Shininess
code_block_9 = CodeBlock { "_test1"; }
create_3 = Orchid.RevitMaterial.Material.Create(name=code_block_9)
code_block_10 = CodeBlock { 50; }
setSmoothness = Orchid.RevitMaterial.Graphics.SetSmoothness(material=create_3, smoothness=code_block_10)
getSmoothness = Orchid.RevitMaterial.Graphics.GetSmoothness(material=setSmoothness)
watch_27 = Watch(getSmoothness)
setShininess = Orchid.RevitMaterial.Graphics.SetShininess(material=create_3, shininess=code_block_10)
getShininess = Orchid.RevitMaterial.Graphics.GetShininess(material=setShininess)
watch_28 = Watch(getShininess)
