# Dynamo graph Graphics_2018.dyn (Dynamo 2.0.3.8810)

# group: Smoothness, Shininess
code_block = CodeBlock { "_test1"; }
create = Orchid.RevitMaterial.Material.Create(name=code_block)
code_block_2 = CodeBlock { 50; }
setSmoothness = Orchid.RevitMaterial.Graphics.SetSmoothness(material=create, smoothness=code_block_2)
getSmoothness = Orchid.RevitMaterial.Graphics.GetSmoothness(material=setSmoothness)
watch = Watch(getSmoothness)
setShininess = Orchid.RevitMaterial.Graphics.SetShininess(material=create, shininess=code_block_2)
getShininess = Orchid.RevitMaterial.Graphics.GetShininess(material=setShininess)
watch_2 = Watch(getShininess)

# group: Create, Get --> For Revit 2018
code_block_3 = CodeBlock { "_test4"; }
create_2 = Orchid.RevitMaterial.Material.Create(name=code_block_3)
watch_3 = Watch(create_2)
boolean = BoolSelector(false)  # graph input
code_block_4 = CodeBlock { DSCore.Color.ByARGB(255,25,60,30); 50; }
fill_patterns = FillPatterns(index=5)  # graph input
code_block_5 = CodeBlock { 45; 85; 65; }
byARGB = Color.ByARGB(r=code_block_5.out0, g=code_block_5.out1, b=code_block_5.out2)
setGraphics = Orchid.RevitMaterial.Graphics.SetGraphics(material=create_2, useRenderAppearance=boolean, shadingColor=code_block_4.out0, transparency=code_block_4.out1, surfacePattern=fill_patterns, surfacePatternColor=byARGB)
getGraphics = Orchid.RevitMaterial.Graphics.GetGraphics(material=setGraphics)
watch_4 = Watch(getGraphics.UseRenderAppearance)
watch_5 = Watch(getGraphics.ShadingColor)
watch_6 = Watch(getGraphics.Transparency)
watch_7 = Watch(getGraphics.SurfacePattern)
watch_8 = Watch(getGraphics.SurfacePatternColor)
watch_9 = Watch(getGraphics.CutPattern)
name = Material.Name(material=create_2)
watch_10 = Watch(name)
watch_11 = Watch(getGraphics.CutPatternColor)

# group: Create, Set Render Appearance, SetShadingColor, Set Transparency, Set Surface Pattern, Set Surface Pattern Color, Set Cut Pattern, Set Cut Pattern Color --> For Revit 2018
code_block_6 = CodeBlock { "_test5"; }
create_3 = Orchid.RevitMaterial.Material.Create(name=code_block_6)
watch_12 = Watch(create_3)
name_2 = Material.Name(material=create_3)
watch_13 = Watch(name_2)
code_block_7 = CodeBlock { DSCore.Color.ByARGB(255,25,60,30); }
setShadingColor = Orchid.RevitMaterial.Graphics.SetShadingColor(material=create_3, color=code_block_7)
getShadingColor = Orchid.RevitMaterial.Graphics.GetShadingColor(material=setShadingColor)
watch_14 = Watch(getShadingColor)
code_block_8 = CodeBlock { 75; }
setTransparency = Orchid.RevitMaterial.Graphics.SetTransparency(material=create_3, transparency=code_block_8)
getTransparency = Orchid.RevitMaterial.Graphics.GetTransparency(material=setTransparency)
watch_15 = Watch(getTransparency)
fill_patterns_2 = FillPatterns(index=1)  # graph input
setSurfacePattern = Orchid.RevitMaterial.Graphics.SetSurfacePattern(material=create_3, pattern=fill_patterns_2)
getSurfacePattern = Orchid.RevitMaterial.Graphics.GetSurfacePattern(material=setSurfacePattern)
watch_16 = Watch(getSurfacePattern)
setCutPattern = Orchid.RevitMaterial.Graphics.SetCutPattern(material=create_3, pattern=fill_patterns_2)
getCutPattern = Orchid.RevitMaterial.Graphics.GetCutPattern(material=setCutPattern)
watch_17 = Watch(getCutPattern)
code_block_9 = CodeBlock { 145; 185; 165; }
byARGB_2 = Color.ByARGB(r=code_block_9.out0, g=code_block_9.out1, b=code_block_9.out2)
setCutPatternColor = Orchid.RevitMaterial.Graphics.SetCutPatternColor(material=setCutPattern, color=byARGB_2)
getCutPatternColor = Orchid.RevitMaterial.Graphics.GetCutPatternColor(material=setCutPatternColor)
watch_18 = Watch(getCutPatternColor)
setSurfacePatternColor = Orchid.RevitMaterial.Graphics.SetSurfacePatternColor(material=setSurfacePattern, color=byARGB_2)
getSurfacePatternColor = Orchid.RevitMaterial.Graphics.GetSurfacePatternColor(material=setSurfacePatternColor)
watch_19 = Watch(getSurfacePatternColor)
boolean_2 = BoolSelector(false)  # graph input
setRenderAppearance = Orchid.RevitMaterial.Graphics.SetRenderAppearance(material=create_3, useRenderAppearance=boolean_2)
getRenderAppearance = Orchid.RevitMaterial.Graphics.GetRenderAppearance(material=setRenderAppearance)
watch_20 = Watch(getRenderAppearance)
