# Dynamo graph Material.dyn (Dynamo 2.3.0.5885)
# packages: Orchid 230.1.0.7728

# group: All
all = Orchid.RevitMaterial.Material.All()
name = Material.Name(material=all)
watch = Watch(name)
watch_2 = Watch(all)

# group: Select
string = StringInput("Brick, Common")
byName = Material.ByName(name=string)
watch_3 = Watch(byName)
material = Material("Brick, Common")  # graph input
watch_4 = Watch(material)

# group: Class/Category
getCategory = Orchid.RevitMaterial.Material.GetCategory(material=byName)
watch_5 = Watch(getCategory)
getClass = Orchid.RevitMaterial.Material.GetClass(material=byName)
watch_6 = Watch(getClass)

# group: Asset
asset = Orchid.RevitMaterial.Material.Asset(material=byName)
watch_7 = Watch(asset.Appearance)
watch_8 = Watch(asset.Physical)
watch_9 = Watch(asset.Thermal)

# group: Asset Parameter
assetParameter = Orchid.RevitMaterial.Material.AssetParameter(material=byName)
watch_10 = Watch(assetParameter.Appearance)
watch_11 = Watch(assetParameter.Physical)
watch_12 = Watch(assetParameter.Thermal)

# group: Parameter
parameter = Orchid.RevitMaterial.Material.Parameter(material=byName)
watch_13 = Watch(parameter)

# group: Asset
code_block = CodeBlock(data=byName) { data; }
appearanceAsset = Orchid.RevitMaterial.Material.AppearanceAsset(material=code_block)
watch_14 = Watch(appearanceAsset)
physicalAsset = Orchid.RevitMaterial.Material.PhysicalAsset(material=code_block)
watch_15 = Watch(physicalAsset)
thermalAsset = Orchid.RevitMaterial.Material.ThermalAsset(material=code_block)
watch_16 = Watch(thermalAsset)

# group: If the dynamo parameter fail, then is the parameter name and value returned. Dynamo parameters has no null check and has no internal constructor access, therefore will they fail from time to time and nothing can be done about it!
type = Object.Type(obj=assetParameter.Appearance)
watch_17 = Watch(type)
type_2 = Object.Type(obj=assetParameter.Physical)
watch_18 = Watch(type_2)
type_3 = Object.Type(obj=assetParameter.Thermal)
watch_19 = Watch(type_3)
