# Dynamo graph BuiltInParameter.dyn (Dynamo 2.3.0.5885)
# packages: Orchid 203.2.0.7786

builtin_parameter = BuiltInParameter("MATERIAL_ID_PARAM")  # graph input
all = Orchid.RevitProject.Parameters.BuiltInParameter.All()
name = Orchid.RevitProject.Parameters.BuiltInParameter.Name(parameterId=all)
watch = Watch(name)
watch_2 = Watch(all)
code_block = CodeBlock { "MATERIAL_ID_PARAM"; }
byName = Orchid.RevitProject.Parameters.BuiltInParameter.ByName(name=code_block)
watch_3 = Watch(byName)
name_2 = Orchid.RevitProject.Parameters.BuiltInParameter.Name(parameterId=byName)
watch_4 = Watch(name_2)
label = Orchid.RevitProject.Parameters.BuiltInParameter.Label(parameterId=all)
watch_5 = Watch(label)
label_2 = Orchid.RevitProject.Parameters.BuiltInParameter.Label(parameterId=byName)
watch_6 = Watch(label_2)
