# Dynamo graph Document.dyn (Dynamo 2.0.3.8810)

# group: Does document contain category?
code_block = CodeBlock()
# ---------- code_block.designscript (4 lines) ----------
// Categories to verify
["Areas","Rooms","Spaces"];
"Levels";
"Stairs";
# ----------------------------------------
containCategory = Orchid.RevitProject.Common.Document.ContainCategory(category=code_block.out0)
watch = Watch(containCategory)
categories = Categories(index=457)  # graph input

# group: Does document contain type?
code_block_2 = CodeBlock()
# ---------- code_block_2.designscript (4 lines) ----------
// Types to verify
["Area","Room","Space"];
"Level";
"Stairs";
# ----------------------------------------
containType = Orchid.RevitProject.Common.Document.ContainType(type=code_block_2.out0)
watch_2 = Watch(containType)
element_types = ElementTypes(index=285)  # graph input

# group: All background open documents
opened = Orchid.RevitProject.Common.Document.Opened()
directory_path = StringInput("..\testSet")  # graph input
string = StringInput("*.rfa")  # graph input
boolean = BoolSelector(false)  # graph input
contents = Orchid.Common.Directory.Contents(directory=directory_path, searchString=string, deepSearch=boolean)
backgroundOpen = Orchid.RevitProject.Common.Document.BackgroundOpen(file=contents)
await_ = Orchid.Common.DataStream.Await(pass=opened, waitFor=backgroundOpen)
watch_3 = Watch(await_)

# group: Convert document
python_script = Python()
# ---------- python_script.python (4 lines) ----------
import clr
clr.AddReference("RevitServices")
from RevitServices.Persistence import DocumentManager
OUT = DocumentManager.Instance.CurrentDBDocument
# ----------------------------------------
toOrchidType = Orchid.RevitProject.Common.Document.ToOrchidType(document=python_script)
watch_4 = Watch(toOrchidType)
current = Document.Current()
toOrchidType_2 = Orchid.RevitProject.Common.Document.ToOrchidType(document=current)
watch_5 = Watch(toOrchidType_2)
