# Dynamo graph ExportSchedules.dyn (Dynamo 2.0.4.12684)

# group: Schedules
code_block = CodeBlock { "Room Schedule"; }
byName = Orchid.RevitProject.Views.View.ByName(name=code_block)
getData = Orchid.RevitProject.Schedules.Schedule.GetData(scheduleView=byName)

# group: Export to Excel
string = StringInput(".\Skemaer")  # graph input
code_block_2 = CodeBlock { 0; }
exportExcel = Data.ExportExcel(filePath=string, sheetName=code_block, startRow=code_block_2, startCol=code_block_2, data=getData)
