# Dynamo graph Filter.dyn (Dynamo 2.0.4.12684)

# group: Orchid -> Filter rule for (element) parameters
code_block = CodeBlock { "test2"; }
code_block_2 = CodeBlock { "Windows"; }
byName = Category.ByName(name=code_block_2)
all_elements_of_category = ElementsOfCategory(Category=byName)
firstItem = List.FirstItem(list=all_elements_of_category)
elementType = Element.ElementType(element=firstItem)
code_block_3 = CodeBlock { "Width"; "Greater"; 1000; }
parameterByName = Parameter.ParameterByName(element=elementType, name=code_block_3.out0)
create = Orchid.RevitProject.Filters.FilterRule.Create(parameter=parameterByName, ruleType=code_block_3.out1, value=code_block_3.out2)
code_block_4 = CodeBlock { ["Doors","Windows"]; }
byName_2 = Category.ByName(name=code_block_4)
byRule = Orchid.RevitProject.Filters.ParameterFilter.ByRule(name=code_block, filterRule=create, category=byName_2)

# group: Add filter to view, and set visibility
views = Views(index=0)  # graph input
boolean = BoolSelector(false)  # graph input
addFilter = Orchid.RevitProject.Views.View.AddFilter(view=views, parameterFilter=byRule, visibility=boolean)
filters = View.Filters(view=addFilter)

# group: Convert to Orchid type
code_block_5 = CodeBlock()  # unwired: FilterRule
# ---------- code_block_5.designscript (3 lines) ----------
//provide an
//Autodesk.Revit.DB.FilterRule
FilterRule;
# ----------------------------------------
toOrchidType = Orchid.RevitProject.Filters.FilterRule.ToOrchidType(filterRule=code_block_5)

# group: Ruletype
select_rule_type = RuleTypes(index=4)  # graph input
code_block_6 = CodeBlock()
# ---------- code_block_6.designscript (25 lines) ----------
// Dynamo RuleTypes
// Please notice the spelling
// issue --> GeaterOrEqual
"BeginsWith";
"Contains";
"EndsWith";
"Equals";
"Greater";
"Less";
"GeaterOrEqual";
"GreaterOrEqual";
"LessOrEqual";
"NotBeginsWith";
"NotContains";
"NotEndsWith";
"NotEquals";

// Orchid additional
// Ruletypes
"==";
">";
"<";
">=";
"<=";
"!=";
# ----------------------------------------

# group: Filter rule for user-defined parameters (project, shared, and global parameters)
code_block_7 = CodeBlock()
# ---------- code_block_7.designscript (12 lines) ----------
// Parameter name
"TestStringParameter";
"TestIntegerParameter";
"TestDoubleParameter";

// Rule Type
"==";

// values
"Something";
1000;
1000.0;
# ----------------------------------------
byName_3 = Orchid.RevitProject.Parameters.Parameter.ByName(parameterName=code_block_7.out2)
name = Element.Name(element=byName_3)
watch = Watch(name)
id = Element.Id(element=byName_3)
watch_2 = Watch(id)
code_block_8 = CodeBlock { "test1"; }
create_2 = Orchid.RevitProject.Filters.FilterRule.Create(parameterName=code_block_7.out0, ruleType=code_block_7.out3, value=code_block_7.out4)
create_3 = Orchid.RevitProject.Filters.FilterRule.Create(parameter=byName_3, ruleType=code_block_7.out3, value=code_block_7.out6)
code_block_9 = CodeBlock { ["Doors","Windows"]; }
byName_4 = Category.ByName(name=code_block_9)
boolean_2 = BoolSelector(false)  # graph input

# group: OOTB -> Filter rule for (element) parameters. Notice the need to convert between SI and Imperial units!
code_block_10 = CodeBlock { "test3"; }
code_block_11 = CodeBlock { ["Windows","Doors"]; }
byName_5 = Category.ByName(name=code_block_11)
code_block_12 = CodeBlock { "Greater"; "Width"; 1000; }
convert_between_units = DynamoConvert(code_block_12.out2, MeasurementType="Length", FromConversion="Millimeters", ToConversion="Feet")
code_block_13 = CodeBlock { "Windows"; }
byName_6 = Category.ByName(name=code_block_13)
all_elements_of_category_2 = ElementsOfCategory(Category=byName_6)
firstItem_2 = List.FirstItem(list=all_elements_of_category_2)
elementType_2 = Element.ElementType(element=firstItem_2)
parameterByName_2 = Parameter.ParameterByName(element=elementType_2, name=code_block_12.out1)
byRuleType = Revit.Filter.FilterRule.ByRuleType(type=code_block_12.out0, value=convert_between_units, parameter=parameterByName_2)
byRules = Revit.Filter.ParameterFilterElement.ByRules(name=code_block_10, categories=byName_5, rules=byRuleType)

# group: Get FilterRule and convert to Orchid type ...it can now be sat as an OR filter
code_block_14 = CodeBlock { "test4"; }
getRule = Orchid.RevitProject.Filters.ParameterFilter.GetRule(parameterFilter=byRules)
boolean_3 = BoolSelector(false)  # graph input
byRule_2 = Orchid.RevitProject.Filters.ParameterFilter.ByRule(name=code_block_14, filterRule=getRule, category=byName_2, andOr=boolean_3)

parameter_filters = ParameterFilter(index=0)  # graph input
watch_3 = Watch(parameter_filters)
all = Orchid.RevitProject.Filters.ParameterFilter.All()
watch_4 = Watch(all)
create_4 = List.Create(item0=create_2, item1=create_3)

# group (continued): Filter rule for user-defined parameters (project, shared, and global parameters)
byRule_3 = Orchid.RevitProject.Filters.ParameterFilter.ByRule(name=code_block_8, filterRule=create_4, category=byName_4, andOr=boolean_2)

await_ = Orchid.Common.DataStream.Await(pass=code_block_8, waitFor=byRule_3)
byName_7 = Orchid.RevitProject.Filters.ParameterFilter.ByName(name=await_)
watch_5 = Watch(byName_7)

# group: Add filter rule set
ruleTree = Orchid.RevitProject.Filters.ParameterFilter.RuleTree(parameterFilter=byRule_3)
addRuleSet = Orchid.RevitProject.Filters.ParameterFilter.AddRuleSet(parameterFilter=byRule_3, filterRule=create, ruleTree=ruleTree)
ruleTree_2 = Orchid.RevitProject.Filters.ParameterFilter.RuleTree(parameterFilter=addRuleSet)
watch_6 = Watch(ruleTree_2)
boolean_4 = BoolSelector(false)  # graph input
addRuleSet_2 = Orchid.RevitProject.Filters.ParameterFilter.AddRuleSet(parameterFilter=addRuleSet, filterRule=getRule, ruleTree=ruleTree_2, andOr=boolean_4)
ruleTree_3 = Orchid.RevitProject.Filters.ParameterFilter.RuleTree(parameterFilter=addRuleSet_2)
watch_7 = Watch(ruleTree_3)
code_block_15 = CodeBlock(filterRule=create) { filterRule; [3]; [3,2]; }
boolean_5 = BoolSelector(true)  # graph input
addRuleSet_3 = Orchid.RevitProject.Filters.ParameterFilter.AddRuleSet(parameterFilter=addRuleSet_2, filterRule=code_block_15.filterRule, ruleTree=ruleTree_3, attachedTo=code_block_15.out1, andOr=boolean_5)
ruleTree_4 = Orchid.RevitProject.Filters.ParameterFilter.RuleTree(parameterFilter=addRuleSet_3)
watch_8 = Watch(ruleTree_4)
