# Dynamo graph Form.dyn (Dynamo 2.3.0.5885)
# packages: Orchid 203.2.0.7786

element_types = ElementTypes("FreeFormElement")  # graph input
element_types_2 = ElementTypes("Extrusion")  # graph input
all_elements_of_type = ElementsOfType(element_type=element_types_2)
# note: Dynamo node
solids = Element.Solids(element=all_elements_of_type)
watch = Watch(solids)
solid = Orchid.Common.Geometry.Form.Solid(form=all_elements_of_type)
watch_2 = Watch(solid)

# group: Dynamo Solid
get = Orchid.Common.Geometry.Form.Get()
solid_2 = Orchid.Common.Geometry.Form.Solid(form=get)
watch_3 = Watch(solid_2)
elementIntersect = Orchid.Common.Geometry.Solid.ElementIntersect(solid=solid_2)
watch_4 = Watch(elementIntersect)
union = Orchid.Common.Geometry.Solid.Union(solid=solid_2)
area = Solid.Area(solid=union)
watch_5 = Watch(area)
volume = Solid.Volume(solid=union)
watch_6 = Watch(volume)
watch_7 = Watch(union)
toOrchidType = Orchid.Common.Geometry.Solid.ToOrchidType(solid=union)
watch_8 = Watch(toOrchidType)

# group: Orchid Solid
get_2 = Orchid.Common.Geometry.Form.Get()
ocSolid = Orchid.Common.Geometry.Form.OcSolid(form=get_2)
elementIntersect_2 = Orchid.Common.Geometry.OcSolid.ElementIntersect(ocSolid=ocSolid)
watch_9 = Watch(elementIntersect_2)
watch_10 = Watch(ocSolid)
union_2 = Orchid.Common.Geometry.OcSolid.Union(ocSolid=ocSolid)
area_2 = Orchid.Common.Geometry.OcSolid.Area(ocSolid=union_2)
watch_11 = Watch(area_2)
volumne = Orchid.Common.Geometry.OcSolid.Volumne(ocSolid=union_2)
watch_12 = Watch(volumne)
watch_13 = Watch(union_2)
toDynamoType = Orchid.Common.Geometry.OcSolid.ToDynamoType(ocSolid=union_2)
watch_14 = Watch(toDynamoType)
