# Dynamo graph GenericForm.dyn (Dynamo 2.3.0.5885)
# packages: Orchid 230.1.0.7760, Orchid 230.1.0.7763

element_types = ElementTypes("FreeFormElement")  # graph input
union = Orchid.Common.Geometry.Solid.Union()  # unwired: solid
element_types_2 = ElementTypes("Extrusion")  # graph input
all_elements_of_type = ElementsOfType(element_type=element_types_2)
solids = Element.Solids(element=all_elements_of_type)
watch = Watch(solids)
solid = Orchid.Common.Geometry.GenericForm.Solid(form=all_elements_of_type)
watch_2 = Watch(solid)
get = Orchid.Common.Geometry.GenericForm.Get()
solid_2 = Orchid.Common.Geometry.GenericForm.Solid(form=get)
watch_3 = Watch(solid_2)
