# Dynamo graph Group.dyn (Dynamo 2.0.4.12684)

# group: Does document contain category?
code_block = CodeBlock()
# ---------- code_block.designscript (9 lines) ----------
"Model";
"Annotation";
"AnalyticalModel";
"Internal";

["Model",
"Annotation",
"AnalyticalModel",
"Internal"];
# ----------------------------------------
elementByCategoryType = Orchid.RevitProject.Elements.Selection.ElementByCategoryType(categoryType=code_block.out0)
watch = Watch(elementByCategoryType.Element)
code_block_2 = CodeBlock { "test"; }
flatten = List.Flatten(list=elementByCategoryType.Element)
create = Orchid.RevitProject.Elements.Group.Create(name=code_block_2, element=flatten)

# group: Group delete
code_block_3 = CodeBlock { "test"; }
delete = Orchid.RevitProject.Elements.Group.Delete(name=code_block_3)  # frozen
groups = Group()  # nothing selected; graph input
delete_2 = Orchid.RevitProject.Elements.Group.Delete(group=groups)  # frozen
getByName = Orchid.RevitProject.Elements.Group.GetByName(name=code_block_3)
delete_3 = Orchid.RevitProject.Elements.Group.Delete(group=getByName)  # frozen

# group: Group ungroup
code_block_4 = CodeBlock { "test"; }
unGroup = Orchid.RevitProject.Elements.Group.UnGroup(name=code_block_4)  # frozen
groups_2 = Group()  # nothing selected; graph input
unGroup_2 = Orchid.RevitProject.Elements.Group.UnGroup(group=groups_2)  # frozen
getByName_2 = Orchid.RevitProject.Elements.Group.GetByName(name=code_block_4)
unGroup_3 = Orchid.RevitProject.Elements.Group.UnGroup(group=getByName_2)  # frozen

# group: GroupType delete
code_block_5 = CodeBlock { "test"; }
delete_4 = Orchid.RevitProject.Elements.GroupType.Delete(name=code_block_5)  # frozen
groupTypes = GroupType()  # nothing selected; graph input
delete_5 = Orchid.RevitProject.Elements.GroupType.Delete(groupType=groupTypes)  # frozen
