# Dynamo graph Ifc.dyn (Dynamo 1.3.4.6666)

# group: Select IFC setting
code_block = CodeBlock { "<In-Session Setup>"; "IFC2x3 Coordination View 2.0"; "DanEDU - IFC2x3 Coordination View 2.0"; }
settingByName = Orchid.IfcExport.IFC.SettingByName(code_block.out0)

# group: IFC setting --> General
ifc_space_boundaries = SpaceBoundary("1st Level")
ifc_project_origin = SitePlacement("Internal coordinates")
boolean = BoolSelector(true)
settingGeneral = Orchid.IfcExport.IFC.SettingGeneral(settingByName, arg3=ifc_space_boundaries, arg4=ifc_project_origin, arg5=boolean)
ifc_file_types = FileType("IFC")
ifc_versions = Version("IFC4 Design Transfer View")

# group: IFC setting --> Additional/LOD
boolean_2 = BoolSelector(true)
ifc_level_of_detail = LevelOfDetail("Medium")
settingAdditional = Orchid.IfcExport.IFC.SettingAdditional(settingGeneral, arg3=boolean_2, arg5=ifc_level_of_detail)

# group: IFC setting --> Property
boolean_3 = BoolSelector(true)
string = StringInput("..\testIFCexport.json")
settingProperty = Orchid.IfcExport.IFC.SettingProperty(settingAdditional, arg3=boolean_3, arg7=string)

# group: IFC setting --> Advanced
boolean_4 = BoolSelector(true)
settingAdvanced = Orchid.IfcExport.IFC.SettingAdvanced(settingProperty, arg7=boolean_4)

# group: IFC setting file format
type = Object.Type(settingAdvanced)
watch = Watch(type)
watch_2 = Watch(settingAdvanced)

# group: IFC Export
current = Orchid.Common.Directory.Current()
string_2 = StringInput("test")
code_block_2 = CodeBlock(t1=current, t2=string_2) { t1+"\\"+t2; }
views = Views("{3D}")
export = Orchid.IfcExport.IFC.Export(arg1=settingAdvanced, arg2=views)
watch_3 = Watch(export)
boolean_5 = BoolSelector(false)
phases = Phase("Existing")

# group: IFC Export --> Multiple document export
string_3 = StringInput(".\defaultBuilding_2019.rvt")
backgroundOpen = Orchid.RevitProject.Common.Document.BackgroundOpen(string_3)
export_2 = Orchid.IfcExport.IFC.Export(backgroundOpen)
await_ = Orchid.Common.DataStream.Await(backgroundOpen, export_2)
close = Orchid.RevitProject.Common.Document.Close(await_)
watch_4 = Watch(export_2)

# group: IFC Export based on prebuild IFC setting and a view
ifc_setting = Setting("IFC2x3 Coordination View 2.0")
settingByName_2 = Orchid.IfcExport.IFC.SettingByName(ifc_setting)
views_2 = Views("{3D}")
export_3 = Orchid.IfcExport.IFC.Export(arg1=settingByName_2, arg2=views_2)

# group: IFC Setting
string_4 = StringInput("dummy")
createSetting = Orchid.IfcExport.IFC.CreateSetting(string_4)  # frozen
code_block_3 = CodeBlock { "<In-Session Setup>"; "IFC2x3 Coordination View 2.0"; "DanEDU - IFC2x3 Coordination View 2.0"; }
settingByName_3 = Orchid.IfcExport.IFC.SettingByName(code_block_3.out1)
duplicateSetting = Orchid.IfcExport.IFC.DuplicateSetting(settingByName_3, string_4)  # frozen
renameSetting = Orchid.IfcExport.IFC.RenameSetting(settingByName_3, string_4)  # frozen
removeSetting = Orchid.IfcExport.IFC.RemoveSetting(string_4)  # frozen
string_5 = StringInput("..\testIFCexport.json")
importSetting = Orchid.IfcExport.IFC.ImportSetting(string_5)  # frozen

# group: IFC File Type
ifc_file_types_2 = FileType("IFC")
string_6 = StringInput("ifc")
fileTypeByName = Orchid.IfcExport.IFC.FileTypeByName(string_6)
allFileType = Orchid.IfcExport.IFC.AllFileType()

watch_5 = Watch(allFileType)

# group: IFC Version
allVersion = Orchid.IfcExport.IFC.AllVersion()
ifc_versions_2 = Version("IFC2x3 Coordination View 2.0")
string_7 = StringInput("IFC2x3")
versionByName = Orchid.IfcExport.IFC.VersionByName(string_7)

watch_6 = Watch(allVersion)

# group: IFC Setting
allSetting = Orchid.IfcExport.IFC.AllSetting()
ifc_settings = Setting("IFC2x3 Coordination View 2.0")
string_8 = StringInput("IFC2x3 Coordination View 2.0")
settingByName_4 = Orchid.IfcExport.IFC.SettingByName(string_8)

watch_7 = Watch(allSetting)
