# Dynamo graph LinkRepath.dyn (Dynamo 2.6.1.8786)
# packages: Orchid 206.3.0.7893

string = StringInput("%userprofile%\Programming\Source\Testing\Data\2021_Data\")  # graph input
string_2 = StringInput("LinkedProject_2021")  # graph input
code_block = CodeBlock(a=string, b=string_2) { a+b+".rvt"; }
fromPath = Orchid.Common.File.FromPath(path=code_block)
backgroundOpen = Orchid.RevitProject.Common.Document.BackgroundOpen(file=fromPath)
getRevitLink = Orchid.RevitProject.Common.Link.GetRevitLink(document=backgroundOpen)
string_3 = StringInput("%userprofile%\Programming\Source\Testing\Data\2019_Data\")  # graph input
string_4 = StringInput("defaultProject_2021")  # graph input
code_block_2 = CodeBlock(a=string_3, b=string_4) { a+b+".rvt"; }
fromPath_2 = Orchid.Common.File.FromPath(path=code_block_2)
repath = Orchid.RevitProject.Common.Link.Repath(link=getRevitLink, file=fromPath_2)
await_ = Orchid.Common.DataStream.Await(pass=getRevitLink, waitFor=repath)
boolean = BoolSelector(false)  # graph input
close = Orchid.RevitProject.Common.Document.Close(document=await_, save=boolean)
