# Dynamo graph LinkedCloudDocument.dyn (Dynamo 2.6.1.8786)
# packages: Orchid 206.3.0.7878

# group: Get Revit Linked document
getRevitLink = Orchid.RevitProject.Common.Link.GetRevitLink()
info = Orchid.RevitProject.Common.Link.Info(link=getRevitLink)
list_create = List.Create(item0=info.Name, item1=info.Status, item2=info.ReferenceType, item3=info.Path, item4=info.PathType)
watch = Watch(list_create)

# group: Get Link
getLink = Orchid.RevitProject.Common.Link.GetLink()
watch_2 = Watch(getLink.Type)
watch_3 = Watch(getLink.Link)

reload = Orchid.RevitProject.Common.Link.Reload(link=getRevitLink)  # frozen
watch_4 = Watch(reload)

# group: Get Link by type
code_block = CodeBlock { "RevitLink"; }
link_types = LinkType("Revit Link")
getLinkByType = Orchid.RevitProject.Common.Link.GetLinkByType(linkType=link_types)
watch_5 = Watch(getLinkByType)
