# Dynamo graph LinkedCloudDocumentRepath.dyn (Dynamo 2.6.1.8786)
# packages: Orchid 206.3.0.7894

# group: Get Revit Linked document
getRevitLink = Orchid.RevitProject.Common.Link.GetRevitLink()
info = Orchid.RevitProject.Common.Link.Info(link=getRevitLink)
list_create = List.Create(item0=info.Name, item1=info.Status, item2=info.ReferenceType, item3=info.Path, item4=info.PathType)
watch = Watch(list_create)

# group: Repath Cloud link to local path
cloudToLocal = Orchid.Common.File.CloudToLocal(path=info.Path)
watch_2 = Watch(cloudToLocal.relative)
watch_3 = Watch(cloudToLocal.absolute)
cloudToLocal_2 = Orchid.Common.Directory.CloudToLocal(path=info.Path)
watch_4 = Watch(cloudToLocal_2.relative)
watch_5 = Watch(cloudToLocal_2.absolute)
repath = Orchid.RevitProject.Common.Link.Repath(link=getRevitLink, file=cloudToLocal.absolute)
