# Dynamo graph LinkedDocument-pin.dyn (Dynamo 2.0.4.12684)

string = StringInput(".\2019_defaultProject.rvt")  # graph input
backgroundOpen = Orchid.RevitProject.Common.Document.BackgroundOpen(file=string)

# group: Link revit file
string_2 = StringInput(".\defaultBuilding_2019.rvt")  # graph input
link_positioning = Positioning(index=1)  # graph input
code_block = CodeBlock { 10000; }
byCoordinates = Point.ByCoordinates(y=code_block)
attachment_type = AttachmentType(index=0)  # graph input
boolean = BoolSelector(true)  # graph input
setRevitFile = Orchid.RevitProject.Common.Link.SetRevitFile(document=backgroundOpen, file=string_2, positioning=link_positioning, referencePoint=byCoordinates, attachmentType=attachment_type, relative=boolean)

watch = Watch(setRevitFile.Instance)
watch_2 = Watch(setRevitFile.Link)
pin = Orchid.RevitProject.Elements.Element.Pin(document=backgroundOpen, element=setRevitFile.Instance)
await_ = Orchid.Common.DataStream.Await(pass=backgroundOpen, waitFor=pin)
name = Orchid.RevitProject.Common.Document.Name(document=backgroundOpen)
code_block_2 = CodeBlock(name=name) { name+"_copy.rvt"; true; }
saveAs = Orchid.RevitProject.Common.Document.SaveAs(document=await_, name=code_block_2.out0, overwrite=code_block_2.out1)
close = Orchid.RevitProject.Common.Document.Close(document=saveAs)

# group: Pin
categories = Categories(index=604)  # graph input
all_elements_of_category = ElementsOfCategory(Category=categories)  # frozen
pin_2 = Orchid.RevitProject.Elements.Element.Pin(element=all_elements_of_category)
unPin = Orchid.RevitProject.Elements.Element.UnPin(element=all_elements_of_category)

# group: Pin
categories_2 = Categories(index=604)  # graph input
all_elements_of_category_2 = ElementsOfCategory(Category=categories_2)  # frozen
pin_3 = Orchid.RevitProject.Elements.Element.Pin(element=all_elements_of_category_2)
unPin_2 = Orchid.RevitProject.Elements.Element.UnPin(element=all_elements_of_category_2)
