# Dynamo graph LinkedDocument.dyn (Dynamo 2.6.1.8786)
# packages: Orchid 206.3.0.7893

# group: Revit links
getRevitLink = Orchid.RevitProject.Common.Link.GetRevitLink()
reload = Orchid.RevitProject.Common.Link.Reload(link=getRevitLink)
string = StringInput("defaultBuilding_2021.rvt")  # graph input
repath = Orchid.RevitProject.Common.Link.Repath(link=getRevitLink, file=string)  # frozen
unload = Orchid.RevitProject.Common.Link.Unload(link=getRevitLink)  # frozen
watch = Watch(getRevitLink)
name = Element.Name(element=getRevitLink)
watch_2 = Watch(name)
path_types = PathType("Relative")

# group: CAD links
getCadLink = Orchid.RevitProject.Common.Link.GetCadLink()
watch_3 = Watch(getCadLink)
name_2 = Element.Name(element=getCadLink)
watch_4 = Watch(name_2)
reload_2 = Orchid.RevitProject.Common.Link.Reload(link=getCadLink)
watch_5 = Watch(reload_2)

# group: Get all links
getLink = Orchid.RevitProject.Common.Link.GetLink()
watch_6 = Watch(getLink.Type)
watch_7 = Watch(getLink.Link)

# group: Dropdown selector
links = Links("Standard")  # graph input
watch_8 = Watch(links)
revit_links = RevitLinks("defaultBuilding_2021.rvt")  # graph input
watch_9 = Watch(revit_links)
cad_links = CadLinks("Drawing1")  # graph input
watch_10 = Watch(cad_links)

# group: Convert to Revit link
select_model_element = DSModelElementSelection()  # nothing selected; graph input; frozen
watch_11 = Watch(select_model_element)
convertToLink = Orchid.RevitProject.Common.Link.ConvertToLink(instance=select_model_element)
watch_12 = Watch(convertToLink)

# group: Convert to CAD link
select_model_element_2 = DSModelElementSelection()  # nothing selected; graph input; frozen
watch_13 = Watch(select_model_element_2)
convertToLink_2 = Orchid.RevitProject.Common.Link.ConvertToLink(instance=select_model_element_2)
watch_14 = Watch(convertToLink_2)

# group: Link revit file
string_2 = StringInput("defaultBuilding_2021.rvt")  # graph input
link_positioning = Positioning("Origin")  # graph input
code_block = CodeBlock { 10000; }
byCoordinates = Point.ByCoordinates(y=code_block)
attachment_types = AttachmentType("Overlay")  # graph input
boolean = BoolSelector(true)  # graph input
setRevitFile = Orchid.RevitProject.Common.Link.SetRevitFile(file=string_2, positioning=link_positioning, referencePoint=byCoordinates, attachmentType=attachment_types, relative=boolean)
watch_15 = Watch(setRevitFile.Instance)
watch_16 = Watch(setRevitFile.Link)

# group: Link cad file
string_3 = StringInput("..\Drawing1.dwg")  # graph input
link_positioning_2 = Positioning("Center")  # graph input
import_units = Unit("Millimeter")  # graph input
import_color_mode = ColorMode("BlackAndWhite")  # graph input
code_block_2 = CodeBlock { -1000; }
byCoordinates_2 = Point.ByCoordinates(y=code_block_2)
model_views = ModelView("Level 1 (door)")  # graph input
boolean_2 = BoolSelector(false)  # graph input
setCadFile = Orchid.RevitProject.Common.Link.SetCadFile(file=string_3, positioning=link_positioning_2, unit=import_units, colorMode=import_color_mode, referencePoint=byCoordinates_2, view=model_views, orientToView=boolean_2)
watch_17 = Watch(setCadFile.Instance)
watch_18 = Watch(setCadFile.Link)

# group: Link cad file
string_4 = StringInput("..\Drawing1.dwg")  # graph input
code_block_3 = CodeBlock { -1000; }
byCoordinates_3 = Point.ByCoordinates(x=code_block_3, y=code_block_3)
model_views_2 = ModelView("Level 1 (door)")  # graph input
boolean_3 = BoolSelector(true)  # graph input

setCadFile_2 = Orchid.RevitProject.Common.Link.SetCadFile(file=string_4, referencePoint=byCoordinates_3, view=model_views_2, orientToView=boolean_3)

# group (continued): Link cad file
watch_19 = Watch(setCadFile_2.Instance)
watch_20 = Watch(setCadFile_2.Link)

# group: Get links by type
link_types = LinkType("Revit Link")
code_block_4 = CodeBlock { "RevitLink"; }
getLinkByType = Orchid.RevitProject.Common.Link.GetLinkByType(linkType=code_block_4)
watch_21 = Watch(getLinkByType)
