# Dynamo graph Location-Level-ReferencePlane.dyn (Dynamo 2.0.4.12684)

# group: Get/Set Elevation
all = Orchid.RevitProject.Datums.Level.All()
boolean = BoolSelector(false)
getElevation = Orchid.RevitProject.Datums.Level.GetElevation(level=all, origin=boolean)
watch = Watch(getElevation)
code_block = CodeBlock { [0,3200,6400]; [2000,5200,8400]; }
setElevation = Orchid.RevitProject.Datums.Level.SetElevation(level=all, value=code_block.out1)
watch_2 = Watch(setElevation)

# group: All levels -> Structural and/or Building Story
all_2 = Orchid.RevitProject.Datums.Level.All()
isStructural = Orchid.RevitProject.Datums.Level.IsStructural(level=all_2)
filterByBoolMask = List.FilterByBoolMask(list=all_2, mask=isStructural)
watch_3 = Watch(filterByBoolMask.in)
isBuildingStory = Orchid.RevitProject.Datums.Level.IsBuildingStory(level=all_2)
filterByBoolMask_2 = List.FilterByBoolMask(list=all_2, mask=isBuildingStory)
watch_4 = Watch(filterByBoolMask_2.in)
structural = Orchid.RevitProject.Datums.Level.Structural()
watch_5 = Watch(structural)
buildingStory = Orchid.RevitProject.Datums.Level.BuildingStory()
watch_6 = Watch(buildingStory)

# group: Level by name
code_block_2 = CodeBlock { "Level 1"; "Some dummy name"; }
byName = Orchid.RevitProject.Datums.Level.ByName(name=code_block_2.out0)
watch_7 = Watch(byName)

# group: Obsolete warning
allLevels = Orchid.RevitProject.Common.Document.AllLevels()
watch_8 = Watch(allLevels)

# group: All reference planes
all_3 = Orchid.RevitProject.Datums.ReferencePlane.All()
plane = ReferencePlane.Plane(referencePlane=all_3)
watch_9 = Watch(plane)
name = Element.Name(element=all_3)
watch_10 = Watch(name)
watch_11 = Watch(all_3)

# group: ReferencePlane by name
code_block_3 = CodeBlock()
# ---------- code_block_3.designscript (9 lines) ----------
// if a reference plane is named
// "Reference Plane", then its a
// generic name, there should fail
// when requested by that name
"Reference Plane";

// Valid name values
"Site";
"Some dummy name";
# ----------------------------------------
byName_2 = Orchid.RevitProject.Datums.ReferencePlane.ByName(name=code_block_3.out1)
watch_12 = Watch(byName_2)

# group: Propagation View
all_4 = Orchid.RevitProject.Datums.Level.All()
activeView = Orchid.RevitProject.Common.Document.ActiveView()
isVisibleInView = Orchid.RevitProject.Datums.Datum.IsVisibleInView(element=all_4, view=activeView)
filterByBoolMask_3 = List.FilterByBoolMask(list=all_4, mask=isVisibleInView)
getPropagationView = Orchid.RevitProject.Datums.Datum.GetPropagationView(element=filterByBoolMask_3.in, view=activeView)
uniqueItems = List.UniqueItems(list=getPropagationView)
setPropagationView = Orchid.RevitProject.Datums.Datum.SetPropagationView(element=filterByBoolMask_3.in, view=activeView, target=uniqueItems)
isVisibleInView_2 = Orchid.RevitProject.Elements.Element.IsVisibleInView(element=all_4, view=activeView)

# group: Site - World Coordinate
siteLocation = Orchid.RevitProject.Common.Location.SiteLocation()
watch_13 = Watch(siteLocation.Latitude)
watch_14 = Watch(siteLocation.Longitude)

# group: Project location - Internal point
project_origin = Origin(index=0)  # graph input
getVector = Orchid.RevitProject.Common.Location.GetVector(location=project_origin)
watch_15 = Watch(getVector)
getPoint = Orchid.RevitProject.Common.Location.GetPoint(location=project_origin)
watch_16 = Watch(getPoint)
set = Orchid.RevitProject.Common.Location.Set(location=project_origin)
watch_17 = Watch(set)
get = Orchid.RevitProject.Common.Location.Get()
watch_18 = Watch(get)
name_2 = Element.Name(element=get)
watch_19 = Watch(name_2)

# group: Project Position -> Survey point
select_model_element = DSModelElementSelection()  # 1 picked in the model; graph input
getProjectPosition = Orchid.RevitProject.Common.Location.GetProjectPosition(element=select_model_element)
watch_20 = Watch(getProjectPosition.NorthSouth)
watch_21 = Watch(getProjectPosition.EastWest)
watch_22 = Watch(getProjectPosition.Elevation)
watch_23 = Watch(getProjectPosition.Angle)
code_block_4 = CodeBlock { 0; 2000; -2000; 10; }
setProjectPosition = Orchid.RevitProject.Common.Location.SetProjectPosition(element=select_model_element, northSouth=code_block_4.out0, eastWest=code_block_4.out0, elevation=code_block_4.out0, angle=code_block_4.out0)
setProjectPosition_2 = Orchid.RevitProject.Common.Location.SetProjectPosition(northSouth=code_block_4.out1, eastWest=code_block_4.out1, elevation=code_block_4.out1, angle=code_block_4.out3)  # frozen
