# Dynamo graph Location.dyn "Project" (Dynamo 2.0.4.12684)

# group: Project phase
phases = Phase(index=3)  # graph input
watch = Watch(phases)

# group: Project location
project_origin = Origin(index=0)  # graph input
getVector = Orchid.RevitProject.Common.Location.GetVector(location=project_origin)
watch_2 = Watch(getVector)
get = Orchid.RevitProject.Common.Location.Get()
watch_3 = Watch(get)
name = Element.Name(element=get)
watch_4 = Watch(name)
getPoint = Orchid.RevitProject.Common.Location.GetPoint(location=project_origin)
watch_5 = Watch(getPoint)
set = Orchid.RevitProject.Common.Location.Set(location=project_origin)
watch_6 = Watch(set)
