# Dynamo graph MoveToOrigin.dyn (Dynamo 2.3.0.5885)
# packages: Orchid 230.1.0.7706

# group: Revisions -> delete or add
deleteAll = Orchid.RevitProject.Common.Revision.DeleteAll()  # frozen
all = Orchid.RevitProject.Common.RevisionCloud.All()
# note: If revisions is deleted, then remember to
# remove they are added to the "move" list
deleteAll_2 = Orchid.RevitProject.Common.RevisionCloud.DeleteAll()  # frozen

# group: new origin -> as vector
select_model_element = DSModelElementSelection()  # 1 picked in the model; graph input
getLocation = Element.GetLocation(element=select_model_element)
reverse = Orchid.Common.Geometry.Point.Reverse(point=getLocation)

# group: Adjust view crop box
modelAll = Orchid.RevitProject.Views.View.ModelAll()
move = Orchid.RevitProject.Views.View.Move(view=modelAll, point=reverse)

# group: Adjust sectionsbox
code_block = CodeBlock { "3D View"; }
byName = Orchid.RevitProject.Views.ViewType.ByName(name=code_block)
byType = Orchid.RevitProject.Views.View.ByType(viewType=byName)
moveSectionBox = Orchid.RevitProject.Views.View.MoveSectionBox(view3D=byType, point=reverse)

# group: Select elements
code_block_2 = CodeBlock()
# ---------- code_block_2.designscript (2 lines) ----------
// Category type elements
"Model";
# ----------------------------------------
elementByCategoryType = Orchid.RevitProject.Elements.Selection.ElementByCategoryType(categoryType=code_block_2)
allStackedWall = Orchid.RevitProject.Elements.Wall.AllStackedWall()
all_2 = Orchid.RevitProject.Elements.Sweep.All()
getSeparationLine = Orchid.RevitProject.Elements.SpatialElement.GetSeparationLine()
uniqueItems = List.UniqueItems(list=getSeparationLine.Element, lacing=Longest)
join = List.Join(list0=elementByCategoryType.Element, list1=allStackedWall, list2=all_2, list3=uniqueItems)

# group: Create temporary group
code_block_3 = CodeBlock { "dummyx"; }
flatten = List.Flatten(list=join)
create = Orchid.RevitProject.Elements.Group.Create(name=code_block_3, element=flatten)

# group: Select special elements
code_block_4 = CodeBlock { "MultistoryStairs"; }
byName_2 = Orchid.RevitProject.Elements.Types.ByName(name=code_block_4)
all_elements_of_type = ElementsOfType(element_type=byName_2)
all_3 = Orchid.RevitProject.Datums.ReferencePlane.All()
all_4 = Orchid.RevitProject.Datums.Level.All()
all_5 = Orchid.RevitProject.Datums.Grid.All()
allModel = Orchid.RevitProject.Elements.Group.AllModel()
join_2 = List.Join(list0=all_elements_of_type, list1=all_3, list2=all_4, list3=all_5, list4=allModel)

# group: Select elements
code_block_5 = CodeBlock()
# ---------- code_block_5.designscript (2 lines) ----------
// Category type elements
"Annotation";
# ----------------------------------------
elementByCategoryType_2 = Orchid.RevitProject.Elements.Selection.ElementByCategoryType(categoryType=code_block_5)
code_block_6 = CodeBlock(category=elementByCategoryType_2.Category)
# ---------- code_block_6.designscript (3 lines) ----------
category.Name == "Section Boxes" ||
category.Name == "Revision Clouds"
? true : false;
# ----------------------------------------
filterByBoolMask = List.FilterByBoolMask(list=elementByCategoryType_2.Element, mask=code_block_6)

# group: Select additional elements that not can be grouped
allDetail = Orchid.RevitProject.Elements.Group.AllDetail()
ownerViewType = Orchid.RevitProject.Elements.Element.OwnerViewType(element=allDetail)
code_block_7 = CodeBlock(t=ownerViewType) { t != "Detail"? true : false; }
filterByBoolMask_2 = List.FilterByBoolMask(list=allDetail, mask=code_block_7)

# group: part 1 -- join lists and unpin element
join_3 = List.Join(list0=join_2, list1=filterByBoolMask.out, list2=filterByBoolMask_2.in, list3=all)
flatten_2 = List.Flatten(list=join_3)
isPinned = Orchid.RevitProject.Elements.Element.IsPinned(element=flatten_2)
filterByBoolMask_3 = List.FilterByBoolMask(list=flatten_2, mask=isPinned)
unPin = Orchid.RevitProject.Elements.Element.UnPin(element=filterByBoolMask_3.in)
await_ = Orchid.Common.DataStream.Await(pass=flatten_2, waitFor=unPin)

# group: Adjust model
join_4 = List.Join(list0=create, list1=await_)
move_2 = Orchid.RevitProject.Elements.Element.Move(element=join_4, point=reverse)

# group: Cleanup temporary group
await_2 = Orchid.Common.DataStream.Await(pass=create, waitFor=move_2)
getByGroup = Orchid.RevitProject.Elements.GroupType.GetByGroup(group=await_2)
await_3 = Orchid.Common.DataStream.Await(pass=await_2, waitFor=getByGroup)
unGroup = Orchid.RevitProject.Elements.Group.UnGroup(group=await_3)
await_4 = Orchid.Common.DataStream.Await(pass=getByGroup, waitFor=unGroup)
delete = Orchid.RevitProject.Elements.GroupType.Delete(groupType=await_4)

# group: re-pin elements
await_5 = Orchid.Common.DataStream.Await(pass=unPin, waitFor=move_2)
pin = Orchid.RevitProject.Elements.Element.Pin(element=await_5)

# group: copy the coordinates to clipboard
copyTo = Orchid.Common.Clipboard.CopyTo(object=reverse)  # frozen
