# Dynamo graph ParameterAttachedCategories.dyn (Dynamo 2.3.0.5885)
# packages: Orchid 203.2.0.7783

# group: Add BIM7AA parameters
code_block = CodeBlock { ["Doors", "Walls"]; }  # frozen
byName = Category.ByName(name=code_block)
addBIM7AA = Orchid.RevitProject.Parameters.SharedParameter.AddBIM7AA(category=byName)

code_block_2 = CodeBlock { "Occupant"; "IfcExportAs"; "BIM7AATypeID"; }
byName_2 = Orchid.RevitProject.Parameters.Parameter.ByName(parameterName=code_block_2.out1)
getCategory = Orchid.RevitProject.Parameters.Parameter.GetCategory(parameter=byName_2)
watch = Watch(getCategory)
getCategory_2 = Orchid.RevitProject.Parameters.Parameter.GetCategory(parameterName=code_block_2.out1)
watch_2 = Watch(getCategory_2)
byName_3 = Orchid.RevitProject.Parameters.Definition.ByName(name=code_block_2.out1)
getCategory_3 = Orchid.RevitProject.Parameters.Definition.GetCategory(definition=byName_3)
watch_3 = Watch(getCategory_3)
