# Dynamo graph ParameterHandling.dyn (Dynamo 2.3.0.5885)
# packages: Orchid 203.2.0.7786

# group: Project parameters in document
projectParameters = Orchid.RevitProject.Common.Document.ProjectParameters()
name = Element.Name(element=projectParameters.Parameter)
watch = Watch(name)
watch_2 = Watch(projectParameters.Parameter)
watch_3 = Watch(projectParameters.Definition)

# group: Global parameters in document
globalParameters = Orchid.RevitProject.Common.Document.GlobalParameters()
watch_4 = Watch(globalParameters.Parameter)
name_2 = Element.Name(element=globalParameters.Parameter)
watch_5 = Watch(name_2)
watch_6 = Watch(globalParameters.Definition)

# group: Shared parameters in document
sharedParameters = Orchid.RevitProject.Common.Document.SharedParameters()
watch_7 = Watch(sharedParameters.Parameter)
name_3 = Element.Name(element=sharedParameters.Parameter)
watch_8 = Watch(name_3)
watch_9 = Watch(sharedParameters.Definition)
watch_10 = Watch(sharedParameters.Guid)

# group: clean for unwanted parameters
string = StringInput("ParameterCopy")  # graph input
contains = String.Contains(str=name_3, searchFor=string)
filterByBoolMask = List.FilterByBoolMask(list=sharedParameters.Parameter, mask=contains)
delete = Orchid.RevitProject.Elements.Element.Delete(element=filterByBoolMask.in)  # frozen
name_4 = Element.Name(element=filterByBoolMask.in)
watch_11 = Watch(name_4)
watch_12 = Watch(filterByBoolMask.in)

# group: Associate --> global parameters
code_block = CodeBlock { "Windows"; }
byName = Category.ByName(name=code_block)
all_elements_of_category = ElementsOfCategory(Category=byName)
code_block_2 = CodeBlock { "AssociateParameter"; }
associate = Orchid.RevitProject.Parameters.GlobalParameter.Associate(element=all_elements_of_category, parameterName=code_block_2, globalParameter=globalParameters.Parameter, lacing=Longest)
await_ = Orchid.Common.DataStream.Await(pass=all_elements_of_category, waitFor=associate)
getAssociated = Orchid.RevitProject.Parameters.GlobalParameter.GetAssociated(element=await_, parameterName=code_block_2)
watch_13 = Watch(getAssociated)
hasAssociated = Orchid.RevitProject.Parameters.GlobalParameter.HasAssociated(element=await_, parameterName=code_block_2)
watch_14 = Watch(hasAssociated)

# group: Parameter definition (external)
code_block_3 = CodeBlock()
# ---------- code_block_3.designscript (4 lines) ----------
//Parameter name
["Creator Name",
"Creator Organization",
"Creator Build"];
# ----------------------------------------
getExternal = Orchid.RevitProject.Parameters.Definition.GetExternal(name=code_block_3)
watch_15 = Watch(getExternal)

# group: Parameter definition
byParameter = Orchid.RevitProject.Parameters.Definition.ByParameter(parameter=sharedParameters.Parameter)
watch_16 = Watch(byParameter)
byName_2 = Orchid.RevitProject.Parameters.Definition.ByName(name=name)
watch_17 = Watch(byName_2)

# group: Definitions
code_block_4 = CodeBlock { "Creator Name"; }
byName_3 = Orchid.RevitProject.Parameters.Parameter.ByName(parameterName=code_block_4)
id = Element.Id(element=byName_3)
byId = Orchid.RevitProject.Parameters.Parameter.ById(id=id)
watch_18 = Watch(byId)
watch_19 = Watch(byName_3)
byParameter_2 = Orchid.RevitProject.Parameters.Definition.ByParameter(parameter=byName_3)
watch_20 = Watch(byParameter_2)
byName_4 = Orchid.RevitProject.Parameters.Definition.ByName(name=code_block_4)
watch_21 = Watch(byName_4)

# group: Parameters
shared_parameters = SharedParameter("Creator Name")
watch_22 = Watch(shared_parameters)
global_parameters = GlobalParameter("GlobalParamTest")
watch_23 = Watch(global_parameters)
project_parameters = ProjectParameter("Occupant")
watch_24 = Watch(project_parameters)

# group: Shared Parameter Definitions
shared_parameter_definitions = SharedParameterDefinition("Creator Organization")
watch_25 = Watch(shared_parameter_definitions)
type = Object.Type(obj=shared_parameter_definitions)

# group: Parameter Definitions
parameter_definitions = ParameterDefinition("Occupant")
watch_26 = Watch(parameter_definitions)
type_2 = Object.Type(obj=parameter_definitions)
