# Dynamo graph ParameterSet.dyn "ParameterGetSet" (Dynamo 2.3.0.5885)
# packages: Orchid 203.2.0.7786

# group: Add project parameter
code_block = CodeBlock()
# ---------- code_block.designscript (14 lines) ----------
//Parameter name
["test1","test2"];
//Parameter type
"Text";
//Parameter group
"PG_IDENTITY_DATA";
//Tooltip
"Some tooltip";
//Instances
true;
//Vary Between Groups
true;
//Category
["Walls","Windows"];
# ----------------------------------------
byName = Category.ByName(name=code_block.out6)
create = Orchid.RevitProject.Parameters.Parameter.Create(parameterName=code_block.out0, type=code_block.out1, group=code_block.out2, tooltip=code_block.out3, instance=code_block.out4, vary=code_block.out5, category=byName)

# group: Add shared parameter
code_block_2 = CodeBlock()
# ---------- code_block_2.designscript (14 lines) ----------
//Parameter name
["Creator Name",
"Creator Organization",
"Creator Build"];
//SP Parameter group
"Sheet & Project";
//Parameter group
"PG_ADSK_MODEL_PROPERTIES";
//Instances
true;
//Vary Between Groups
true;
//Category
"Doors";
# ----------------------------------------
byName_2 = Category.ByName(name=code_block_2.out5)
add = Orchid.RevitProject.Parameters.SharedParameter.Add(parameterName=code_block_2.out0, groupName=code_block_2.out1, group=code_block_2.out2, category=byName_2)

# group: Change parameter and category binding in the project
code_block_3 = CodeBlock()
# ---------- code_block_3.designscript (17 lines) ----------
// Parameter name
// Note: a project parameter created inside
// Revit can't be changed! Only user-defined
// parameters created from Dynamo and shared
// parameters can be changed!

// test, shared parameter;
"Creator Name";
// test, created from Dynamo;
"test1";
// test, created inside Revit;
"ChangeCategory";

//Instances
true;
//Category
["Doors", "Entourage", "Floors"];
# ----------------------------------------
byName_3 = Category.ByName(name=code_block_3.out4)
changeCategory = Orchid.RevitProject.Parameters.Parameter.ChangeCategory(parameterName=code_block_3.out0, category=byName_3)
byName_4 = Orchid.RevitProject.Parameters.Parameter.ByName(parameterName=code_block_3.out0)
changeCategory_2 = Orchid.RevitProject.Parameters.Parameter.ChangeCategory(parameter=byName_4, category=byName_3)  # frozen

# group: Delete parameter
code_block_4 = CodeBlock()
# ---------- code_block_4.designscript (2 lines) ----------
["Creator Build",
"test2"];
# ----------------------------------------
delete = Orchid.RevitProject.Parameters.Parameter.Delete(parameterName=code_block_4)  # frozen

# group: Create shared parameter
code_block_5 = CodeBlock()
# ---------- code_block_5.designscript (16 lines) ----------
//Parameter name
"Dynamo test parameter";
//SP Parameter group
"Dynamo test group";
//SP Parameter type
"Text";
//Parameter group
"PG_ADSK_MODEL_PROPERTIES";
//Tooltip
"Some tooltip";
//Instances
true;
//Vary Between Groups
true;
//Category
"Doors";
# ----------------------------------------
byName_5 = Category.ByName(name=code_block_5.out7)
create_2 = Orchid.RevitProject.Parameters.SharedParameter.Create(parameterName=code_block_5.out0, groupName=code_block_5.out1, type=code_block_5.out2, group=code_block_5.out3, tooltip=code_block_5.out4, category=byName_5)  # frozen
add_2 = Orchid.RevitProject.Parameters.SharedParameter.Add(parameterName=code_block_5.out0, groupName=code_block_5.out1, group=code_block_5.out3, instance=code_block_5.out5, vary=code_block_5.out6, category=byName_5)  # frozen
