# Dynamo graph RoomSpace.dyn (Dynamo 2.6.1.8786)
# packages: Orchid 206.3.0.7929

# group: Create room by phase
code_block = CodeBlock { "Rooms"; "Existing"; "New Construction"; }
byName = Orchid.RevitProject.Common.Phase.ByName(name=code_block.out1)
levels = Levels("Level 2")
byName_2 = Category.ByName(name=code_block.out0)
all_elements_of_category = ElementsOfCategory(Category=byName_2)
centerLocation = Orchid.RevitProject.Elements.SpatialElement.CenterLocation(spatialElement=all_elements_of_category)
location = Room.Location(room=centerLocation)
name = Room.Name(room=centerLocation)
number = Room.Number(room=centerLocation)
createRoom = Orchid.RevitProject.Elements.SpatialElement.CreateRoom(phase=byName, level=levels, location=location, name=name, number=number)
centerLocation_2 = Orchid.RevitProject.Elements.SpatialElement.CenterLocation(spatialElement=createRoom)

# group: Create space by phase
code_block_2 = CodeBlock { "Spaces"; "Existing"; "New Construction"; }
byName_3 = Orchid.RevitProject.Common.Phase.ByName(name=code_block_2.out1)
levels_2 = Levels("Level 2")
byName_4 = Category.ByName(name=code_block_2.out0)
all_elements_of_category_2 = ElementsOfCategory(Category=byName_4)
centerLocation_3 = Orchid.RevitProject.Elements.SpatialElement.CenterLocation(spatialElement=all_elements_of_category_2)
location_2 = Space.Location(space=centerLocation_3)
name_2 = Space.Name(space=centerLocation_3)
number_2 = Space.Number(space=centerLocation_3)
createSpace = Orchid.RevitProject.Elements.SpatialElement.CreateSpace(phase=byName_3, level=levels_2, location=location_2, name=name_2, number=number_2)
centerLocation_4 = Orchid.RevitProject.Elements.SpatialElement.CenterLocation(spatialElement=createSpace)

# group: Get spatial element status
code_block_3 = CodeBlock { ["Rooms", "Spaces"]; }
byName_5 = Category.ByName(name=code_block_3)
all_elements_of_category_3 = ElementsOfCategory(Category=byName_5)
status = Orchid.RevitProject.Elements.SpatialElement.Status(spatialElement=all_elements_of_category_3)
groupByKey = List.GroupByKey(list=all_elements_of_category_3, keys=status, lacing=Longest)
watch = Watch(groupByKey.unique_keys)
watch_2 = Watch(groupByKey.groups)

# group: Get spatial element phase
code_block_4 = CodeBlock { ["Rooms", "Spaces"]; }
byName_6 = Category.ByName(name=code_block_4)
all_elements_of_category_4 = ElementsOfCategory(Category=byName_6)
getPhase = Orchid.RevitProject.Elements.SpatialElement.GetPhase(spatialElement=all_elements_of_category_4)
groupByKey_2 = List.GroupByKey(list=all_elements_of_category_4, keys=getPhase, lacing=Longest)
watch_3 = Watch(groupByKey_2.unique_keys)
watch_4 = Watch(groupByKey_2.groups)
