# Dynamo graph RoomSpacePhase.dyn (Dynamo 2.6.1.8786)
# packages: Orchid 206.3.0.7927

# group: Create room by phase
code_block = CodeBlock { "Rooms"; "Existing"; "New Construction"; }
phaseByName = Orchid.RevitProject.Elements.Element.PhaseByName(name=code_block.out1)
levels = Levels("Level 2")
byName = Category.ByName(name=code_block.out0)
all_elements_of_category = ElementsOfCategory(Category=byName)
centerLocation = Orchid.RevitProject.Elements.SpatialElement.CenterLocation(spatialElement=all_elements_of_category)
location = Room.Location(room=centerLocation)
name = Room.Name(room=centerLocation)
number = Room.Number(room=centerLocation)
createRoom = Orchid.RevitProject.Elements.SpatialElement.CreateRoom(phase=phaseByName, level=levels, location=location, name=name, number=number)
centerLocation_2 = Orchid.RevitProject.Elements.SpatialElement.CenterLocation(spatialElement=createRoom)

# group: Create space by phase
code_block_2 = CodeBlock { "Spaces"; "Existing"; "New Construction"; }
phaseByName_2 = Orchid.RevitProject.Elements.Element.PhaseByName(name=code_block_2.out1)
levels_2 = Levels("Level 2")
byName_2 = Category.ByName(name=code_block_2.out0)
all_elements_of_category_2 = ElementsOfCategory(Category=byName_2)
centerLocation_3 = Orchid.RevitProject.Elements.SpatialElement.CenterLocation(spatialElement=all_elements_of_category_2)
location_2 = Space.Location(space=centerLocation_3)
name_2 = Space.Name(space=centerLocation_3)
number_2 = Space.Number(space=centerLocation_3)
createSpace = Orchid.RevitProject.Elements.SpatialElement.CreateSpace(phase=phaseByName_2, level=levels_2, location=location_2, name=name_2, number=number_2)
centerLocation_4 = Orchid.RevitProject.Elements.SpatialElement.CenterLocation(spatialElement=createSpace)
