# Dynamo graph Scheduling.dyn (Dynamo 2.3.0.5885)
# packages: Orchid 230.1.0.7730

# group: Selection
code_block = CodeBlock { "Model"; "Annotation"; "AnalyticalModel"; "Internal"; }
elementByCategoryType = Orchid.RevitProject.Elements.Selection.ElementByCategoryType(categoryType=code_block.out0)
watch = Watch(elementByCategoryType.Category)
copyTo = Orchid.Common.Clipboard.CopyTo(object=elementByCategoryType.Category)

# group: Add shared parameter
code_block_2 = CodeBlock()
# ---------- code_block_2.designscript (6 lines) ----------
//Parameter name
"BIM7AATypeID";
//SP Parameter group
"BIM7AA";
//Parameter group
"PG_ADSK_MODEL_PROPERTIES";
# ----------------------------------------
add = Orchid.RevitProject.Parameters.SharedParameter.Add(parameterName=code_block_2.out0, groupName=code_block_2.out1, group=code_block_2.out2)

# group: Create Schedules
code_block_3 = CodeBlock()
# ---------- code_block_3.designscript (7 lines) ----------
[
"Ceilings",
"Doors",
"Floors",
"Windows",
"Walls"
];
# ----------------------------------------
byName = Category.ByName(name=code_block_3)
code_block_4 = CodeBlock(category=byName) { t = category; t+" Shedule"; "RegularSchedule"; }
createSchedule = ScheduleView.CreateSchedule(category=code_block_4.t, name=code_block_4.out1, scheduleType=code_block_4.out2)
await_ = Orchid.Common.DataStream.Await(pass=createSchedule, waitFor=add)
schedulableFields = ScheduleView.SchedulableFields(scheduleView=await_)
code_block_5 = CodeBlock()
# ---------- code_block_5.designscript (9 lines) ----------
[
"BIM7AATypeID",
"Type",
"Count",

// these are not avalible
// in all schedules!
"Level",
"Base Constraint"];
# ----------------------------------------
byName_2 = Orchid.RevitProject.Schedules.SchedulableField.ByName(schedulableField=schedulableFields@L2, name=code_block_5)
clean = Orchid.Common.List.Clean(list=byName_2)
addFields = ScheduleView.AddFields(scheduleView=createSchedule@L1, fields=clean@L2)

# group: Set the schedule
schedule_footer_type = ScheduleFooterType("Totals")
code_block_6 = CodeBlock()
# ---------- code_block_6.designscript (7 lines) ----------
["BIM7AATypeID","Type"];
// footer
["Totals","None"];
// blankLine
[true,false];
"Totals";
true;
# ----------------------------------------
sortingGrouping = Orchid.RevitProject.Schedules.Schedule.SortingGrouping(scheduleView=addFields, name=code_block_6.out0, footer=code_block_6.out1, blankLine=code_block_6.out2, grandTotals=code_block_6.out3, itemize=code_block_6.out4)
code_block_7 = CodeBlock { "Count"; "Right"; "Totals"; }
formatting = Orchid.RevitProject.Schedules.Schedule.Formatting(scheduleView=sortingGrouping, name=code_block_7.out0, horizontalAlignment=code_block_7.out1, calculate=code_block_7.out2)
schedule_field_display_type = ScheduleFieldDisplayType("Totals")
horizontal_alignment_style = HorizontalAlignmentStyle("Right")
schedule_sort_order = ScheduleSortOrder("Ascending")
schedule_heading_orientations = ScheduleHeadingOrientation("Horizontal")
