# Dynamo graph SharedParameter.dyn (Dynamo 2.0.4.12684)

# group: Set the shared parameter file
string = StringInput("..\COBie Extension Shared Parameters.txt")  # graph input
code_block = CodeBlock(data=string) { data; }
setFile = Orchid.RevitProject.Parameters.SharedParameter.SetFile(file=code_block)
watch = Watch(setFile)
string_2 = StringInput("%userprofile%\Personal\Modellering\Revit\Common\Shared Parameters.txt")  # graph input
fromPath = Orchid.Common.File.FromPath(path=string_2)
string_3 = StringInput("%userprofile%\Programming\Source\Testing\Data\COBie Extension Shared Parameters.txt")  # graph input
fromPath_2 = Orchid.Common.File.FromPath(path=string_3)

# group: Group by group name and type
groupByGroupNameAndType = Orchid.RevitProject.Parameters.SharedParameter.GroupByGroupNameAndType(file=setFile)
watch_2 = Watch(groupByGroupNameAndType.ParameterName)
watch_3 = Watch(groupByGroupNameAndType.GroupName)
watch_4 = Watch(groupByGroupNameAndType.ParameterType)
watch_5 = Watch(groupByGroupNameAndType.Definition)
watch_6 = Watch(groupByGroupNameAndType.Guid)

# group: Group by type and group name
groupByTypeAndGroupName = Orchid.RevitProject.Parameters.SharedParameter.GroupByTypeAndGroupName(file=setFile)
watch_7 = Watch(groupByTypeAndGroupName.ParameterName)
watch_8 = Watch(groupByTypeAndGroupName.Definition)
watch_9 = Watch(groupByTypeAndGroupName.ParameterType)
watch_10 = Watch(groupByTypeAndGroupName.GroupName)
watch_11 = Watch(groupByTypeAndGroupName.Guid)

# group: Get shared parameters by file
byFile = Orchid.RevitProject.Parameters.SharedParameter.ByFile(file=setFile)
watch_12 = Watch(byFile.GroupName)
watch_13 = Watch(byFile.ParameterName)
watch_14 = Watch(byFile.ParameterType)
watch_15 = Watch(byFile.Definition)
watch_16 = Watch(byFile.Guid)

# group: Get shared parameter file
getFile = Orchid.RevitProject.Parameters.SharedParameter.GetFile()
watch_17 = Watch(getFile)

# group: Add shared parameters by groupName by provided file
string_4 = StringInput("..\COBie Extension Shared Parameters.txt")  # graph input
code_block_2 = CodeBlock()
# ---------- code_block_2.designscript (15 lines) ----------
//SP Parameter group
["Floor","Type"];
//Parameter group
["INVALID",
"PG_ADSK_MODEL_PROPERTIES"];
//Instance
[true,false];
//Vary pr group
//NOTE: this list must follow the order
//of true values in the "Instance" list.
//This list does not have to have same
//length as the above three lists!
[true];
//Categories
["Doors", "Windows", "Floors", "Walls"];
# ----------------------------------------
byName = Category.ByName(name=code_block_2.out4)
addByFile = Orchid.RevitProject.Parameters.SharedParameter.AddByFile(file=string_4, groupName=code_block_2.out0, group=code_block_2.out1, instance=code_block_2.out2, vary=code_block_2.out3, category=byName)
name = Element.Name(element=addByFile.Parameter)
watch_18 = Watch(name)
watch_19 = Watch(addByFile.GroupName)

# group: Select elements
code_block_3 = CodeBlock()
# ---------- code_block_3.designscript (2 lines) ----------
// Category type elements
"Model";
# ----------------------------------------
elementByCategoryType = Orchid.RevitProject.Elements.Selection.ElementByCategoryType(categoryType=code_block_3)

# group: Add IFC parameters
addIFC = Orchid.RevitProject.Parameters.SharedParameter.AddIFC(category=elementByCategoryType.Category)
name_2 = Element.Name(element=addIFC)
watch_20 = Watch(name_2)

# group: Add BIM7AA parameters
addBIM7AA = Orchid.RevitProject.Parameters.SharedParameter.AddBIM7AA(category=elementByCategoryType.Category)
name_3 = Element.Name(element=addBIM7AA)
watch_21 = Watch(name_3)

# group: Add shared parameters by groupName (current loaded)
code_block_4 = CodeBlock()
# ---------- code_block_4.designscript (15 lines) ----------
//SP Parameter group
["Energy","Dimensions"];
//Parameter group
["PG_ENERGY_ANALYSIS",
"PG_GEOMETRY"];
//Instance
[true,false];
//Vary pr group
//NOTE: this list must follow the order
//of true values in the "Instance" list.
//This list does not have to have same
//length as the above three lists!
[true];
//Categories
["Doors", "Windows", "Floors", "Walls"];
# ----------------------------------------
byName_2 = Category.ByName(name=code_block_4.out4)
addByGroup = Orchid.RevitProject.Parameters.SharedParameter.AddByGroup(groupName=code_block_4.out0, group=code_block_4.out1, instance=code_block_4.out2, vary=code_block_4.out3, category=byName_2)
name_4 = Element.Name(element=addByGroup.Parameter)
watch_22 = Watch(name_4)
watch_23 = Watch(addByGroup.GroupName)

# group: Add CCS parameters
addCCS = Orchid.RevitProject.Parameters.SharedParameter.AddCCS(category=elementByCategoryType.Category)
name_5 = Element.Name(element=addCCS)
watch_24 = Watch(name_5)
