# Dynamo graph Systems.dyn (Dynamo 2.0.4.12684)

# group: Type
electrical_system_type = ElectricalSystemType(index=0)  # graph input
duct_system_type = DuctSystemType(index=0)  # graph input
pipe_system_type = PipeSystemType(index=0)  # graph input

# group: Filter System by type
all = Orchid.RevitProject.Systems.MEPSystem.All()
element_types = ElementTypes(index=188)  # graph input
typeOf = Orchid.RevitProject.Elements.Element.TypeOf(element=all, type=element_types)
name = Element.Name(element=typeOf)
byName = Orchid.RevitProject.Systems.MEPSystem.ByName(name=name)
watch = Watch(name)
watch_2 = Watch(typeOf)
code_block = CodeBlock(system=typeOf) { system; system[0]; }
type = Orchid.RevitProject.Systems.MEPSystem.Type(system=typeOf)
watch_3 = Watch(type)

# group: MEP
mep_system_class = MEPSystemClass(index=0)  # graph input
mep_systems = MEPSystem(index=0)  # graph input
mep_system_types = MEPSystemType(index=30)  # graph input

# group: Filter SystemType by type
all_2 = Orchid.RevitProject.Systems.MEPSystemType.All()
element_types_2 = ElementTypes(index=189)  # graph input
typeOf_2 = Orchid.RevitProject.Elements.Element.TypeOf(element=all_2, type=element_types_2)
name_2 = Element.Name(element=typeOf_2)
byName_2 = Orchid.RevitProject.Systems.MEPSystemType.ByName(name=name_2)
watch_4 = Watch(typeOf_2)
watch_5 = Watch(name_2)

# group: Calculation point
categories = Categories(index=5)  # graph input
all_elements_of_category = ElementsOfCategory(Category=categories)
getFromToCalculationPoints = Orchid.RevitProject.Elements.FamilyInstance.GetFromToCalculationPoints(familyInstance=all_elements_of_category)  # frozen
getSpatialCalculationPoint = Orchid.RevitProject.Elements.FamilyInstance.GetSpatialCalculationPoint(familyInstance=all_elements_of_category)
hasFromToCalculationPoints = Orchid.RevitProject.Elements.FamilyInstance.HasFromToCalculationPoints(familyInstance=all_elements_of_category)  # frozen
hasSpatialCalculationPoint = Orchid.RevitProject.Elements.FamilyInstance.HasSpatialCalculationPoint(familyInstance=all_elements_of_category)
families = Family(index=249)  # graph input
code_block_2 = CodeBlock { "LCA MBB"; "PCA MBB"; }
byName_3 = Family.ByName(name=code_block_2.out1)
hasSpatialCalculationPoint_2 = Orchid.RevitProject.Elements.Family.HasSpatialCalculationPoint(family=byName_3)

# group: System elements
components = Orchid.RevitProject.Systems.Mechanical.Components(mechanicalSystem=code_block.out1)
connector = Orchid.RevitProject.Systems.FamilyInstance.Connector(familyInstance=components)
watch_6 = Watch(connector.Connector)
watch_7 = Watch(connector.Direction)
network = Orchid.RevitProject.Systems.Mechanical.Network(mechanicalSystem=code_block.out1)
ducts = Orchid.RevitProject.Systems.Mechanical.Ducts(mechanicalSystem=code_block.out1)

# group: Duplicate
code_block_3 = CodeBlock { "test"; }
duplicate = Orchid.RevitProject.Systems.Mechanical.Duplicate(mechanicalSystem=code_block.out1, systemName=code_block_3)
watch_8 = Watch(duplicate)

# group: Root Component/Terminal
code_block_4 = CodeBlock(system=code_block.system) { system; }
rootTerminal = Orchid.RevitProject.Systems.MEPSystem.RootTerminal(system=code_block_4)
watch_9 = Watch(rootTerminal)
rootComponent = Orchid.RevitProject.Systems.Mechanical.RootComponent(mechanicalSystem=code_block_4)
watch_10 = Watch(rootComponent)

# group: Components/Terminals
code_block_5 = CodeBlock(system=code_block.system) { system; }
systemTerminals = Orchid.RevitProject.Systems.MEPSystem.SystemTerminals(system=code_block_5)
watch_11 = Watch(systemTerminals)
systemComponents = Orchid.RevitProject.Systems.Mechanical.SystemComponents(mechanicalSystem=code_block_5)
watch_12 = Watch(systemComponents)
terminals = Orchid.RevitProject.Systems.MEPSystem.Terminals(system=code_block_5)
connector_2 = Orchid.RevitProject.Systems.Element.Connector(element=terminals)
watch_13 = Watch(connector_2.Connector)
watch_14 = Watch(connector_2.Direction)
watch_15 = Watch(terminals)

# group: System
MEPSystem = Orchid.RevitProject.Systems.Connector.MEPSystem(connector=connector.Connector)
watch_16 = Watch(MEPSystem.System)
MEPSystem_2 = Orchid.RevitProject.Systems.FamilyInstance.MEPSystem(familyInstance=components)
watch_17 = Watch(MEPSystem_2.System)
MEPSystem_3 = Orchid.RevitProject.Systems.Element.MEPSystem(element=network)
watch_18 = Watch(MEPSystem_3.System)
watch_19 = Watch(MEPSystem_3.Type)
watch_20 = Watch(MEPSystem_2.Type)
watch_21 = Watch(MEPSystem.Type)

# group: SystemType
MEPSystemType = Orchid.RevitProject.Systems.Connector.MEPSystemType(connector=connector.Connector)
watch_22 = Watch(MEPSystemType)
MEPSystemType_2 = Orchid.RevitProject.Systems.FamilyInstance.MEPSystemType(familyInstance=components)
watch_23 = Watch(MEPSystemType_2)
MEPSystemType_3 = Orchid.RevitProject.Systems.Element.MEPSystemType(element=ducts)
watch_24 = Watch(MEPSystemType_3)
