# Dynamo graph View-Cropbox.dyn (Dynamo 2.6.1.8786)
# packages: Orchid 206.3.0.7978

# group: Collect all view
all = Orchid.RevitProject.Views.View.All()
watch = Watch(all)
threeD = Orchid.RevitProject.Views.View.ThreeD()
watch_2 = Watch(threeD)

# group: Collect sselected view by view family type
code_block = CodeBlock()
# ---------- code_block.designscript (3 lines) ----------
["Floor Plan",
"Section",
"3D View"];
# ----------------------------------------
byName = Orchid.RevitProject.Views.ViewFamilyType.ByName(name=code_block)
byFamilyType = Orchid.RevitProject.Views.View.ByFamilyType(viewType=byName)
watch_3 = Watch(byFamilyType)
view_family_types = ViewFamilyType()  # nothing selected

# group: Model view
model_views = ModelView("Level 1 (door)")  # graph input
watch_4 = Watch(model_views)

# group: Sheet view
sheet_views = SheetView("Level 1 (door)")  # graph input
watch_5 = Watch(sheet_views)

# group: Proces by vector
select_model_element = DSModelElementSelection()  # 1 picked in the model; graph input
getLocation = Element.GetLocation(element=select_model_element)
asVector = Point.AsVector(point=getLocation)
reverse = Vector.Reverse(vector=asVector)

# group: Adjust viewport on sheet
all_2 = Orchid.RevitProject.Views.Viewport.All()
move = Orchid.RevitProject.Views.Viewport.Move(viewport=all_2, vector=reverse)

# group: Adjust view
modelAll = Orchid.RevitProject.Views.View.ModelAll()
move_2 = Orchid.RevitProject.Views.View.Move(view=modelAll, vector=reverse)

# group: Adjust view crop box
modelAll_2 = Orchid.RevitProject.Views.View.ModelAll()
moveCropBox = Orchid.RevitProject.Views.View.MoveCropBox(view=modelAll_2, vector=reverse)

# group: Adjust sectionsbox
threeD_2 = Orchid.RevitProject.Views.View.ThreeD()
moveSectionBox = Orchid.RevitProject.Views.View.MoveSectionBox(view3D=threeD_2, vector=reverse)

# group: Adjust view crop box
modelAll_3 = Orchid.RevitProject.Views.View.ModelAll()
getCropBox = Orchid.RevitProject.Views.View.GetCropBox(view=modelAll_3)

# group: ...by bounding box
minPoint = BoundingBox.MinPoint(boundingBox=getCropBox.BoundingBox)
add = Point.Add(point=minPoint, vectorToAdd=reverse)
maxPoint = BoundingBox.MaxPoint(boundingBox=getCropBox.BoundingBox)
add_2 = Point.Add(point=maxPoint, vectorToAdd=reverse)
byCorners = BoundingBox.ByCorners(min=add, max=add_2)
setCropBox = Orchid.RevitProject.Views.View.SetCropBox(view=modelAll_3, boundingBox=byCorners)

# group: ...by curve
startPoint = Curve.StartPoint(curve=getCropBox.Curve)
add_3 = Point.Add(point=startPoint, vectorToAdd=reverse)
endPoint = Curve.EndPoint(curve=getCropBox.Curve)
add_4 = Point.Add(point=endPoint, vectorToAdd=reverse)
byStartPointEndPoint = Line.ByStartPointEndPoint(startPoint=add_3, endPoint=add_4)
setCropBox_2 = Orchid.RevitProject.Views.View.SetCropBox(view=modelAll_3, curve=byStartPointEndPoint)

# group: Scope box
scope_boxes = ScopeBox("No types found.")  # graph input
watch_6 = Watch(scope_boxes)

# group: Design option
design_options = DesignOption("Option 1  <primary>")  # graph input
watch_7 = Watch(design_options)

# group: Collect sselected view by view family type
code_block_2 = CodeBlock()
# ---------- code_block_2.designscript (3 lines) ----------
["FloorPlan",
"Section",
"ThreeD"];
# ----------------------------------------
byName_2 = Orchid.RevitProject.Views.ViewType.ByName(name=code_block_2)
byType = Orchid.RevitProject.Views.View.ByType(viewType=byName_2)
watch_8 = Watch(byType)
view_type = ViewType("FloorPlan")
