# Dynamo graph WallHole.dyn (Dynamo 2.3.0.5885)
# packages: Orchid 203.2.0.7786

# group: Get hole elements as document (family edit)
code_block = CodeBlock { "Generic Models"; }
byName = Category.ByName(name=code_block)
elementByCategory = Orchid.RevitProject.Elements.Selection.ElementByCategory(category=byName)
name = Element.Name(element=elementByCategory.Element)
code_block_2 = CodeBlock()
# ---------- code_block_2.designscript (2 lines) ----------
// Search string
"Hole";
# ----------------------------------------
contains = String.Contains(str=name, searchFor=code_block_2)
filterByBoolMask = List.FilterByBoolMask(list=elementByCategory.Element, mask=contains)
getFamily = FamilyInstance.GetFamily(familyInstance=filterByBoolMask.in)
edit = Orchid.RevitProject.Elements.Family.Edit(family=getFamily)

# group: filter for valid holes
get = Orchid.Common.Geometry.Form.Get(document=edit)
code_block_3 = CodeBlock { "Walls"; }
byName_2 = Category.ByName(name=code_block_3)
elementByCategory_2 = Orchid.RevitProject.Elements.Selection.ElementByCategory(category=byName_2)

# group: find host elements (Solid)
solid = Orchid.Common.Geometry.Form.Solid(form=get)
elementIntersect = Orchid.Common.Geometry.Solid.ElementIntersect(solid=solid, elements=elementByCategory_2.Element)
watch = Watch(elementIntersect)
elementIntersect_2 = Orchid.Common.Geometry.Solid.ElementIntersect(solid=solid)
watch_2 = Watch(elementIntersect_2)

# group: close document
await_ = Orchid.Common.DataStream.Await(pass=edit, waitFor=solid)  # frozen
close = Orchid.RevitProject.Common.Document.Close(document=await_)

# group: find host elements (OcSolid)
ocSolid = Orchid.Common.Geometry.Form.OcSolid(form=get)
elementIntersect_3 = Orchid.Common.Geometry.OcSolid.ElementIntersect(ocSolid=ocSolid, elements=elementByCategory_2.Element)
watch_3 = Watch(elementIntersect_3)
elementIntersect_4 = Orchid.Common.Geometry.OcSolid.ElementIntersect(ocSolid=ocSolid)
watch_4 = Watch(elementIntersect_4)
