# Dynamo graph Connector_Mechanical.dyn (Dynamo 2.3.0.5885)
# packages: Orchid 203.2.0.7790

code_block = CodeBlock { "VI 1"; }
byName = Orchid.RevitProject.Systems.MEPSystem.ByName(name=code_block)

# group: Component
handlingUnit = Orchid.RevitProject.Systems.Mechanical.HandlingUnit(mechanicalSystem=byName)
connector = Orchid.RevitProject.Systems.FamilyInstance.Connector(familyInstance=handlingUnit)
component = Orchid.RevitProject.Systems.Mechanical.Component(mechanicalSystem=byName)
fitting = Orchid.RevitProject.Systems.Mechanical.Fitting(mechanicalSystem=byName)
accessory = Orchid.RevitProject.Systems.Mechanical.Accessory(mechanicalSystem=byName)
terminal = Orchid.RevitProject.Systems.Mechanical.Terminal(mechanicalSystem=byName)
equipment = Orchid.RevitProject.Systems.Mechanical.Equipment(mechanicalSystem=byName)

watch = Watch(connector)
code_block_2 = CodeBlock(data=connector) { data; }
connection = Orchid.RevitProject.Systems.Connector.Connection(connector=code_block_2)
watch_2 = Watch(connection)
isConnected = Orchid.RevitProject.Systems.Connector.IsConnected(connector=code_block_2)
watch_3 = Watch(isConnected)
host = Orchid.RevitProject.Systems.Connector.Host(connector=code_block_2)
watch_4 = Watch(host)

# group: Network
duct = Orchid.RevitProject.Systems.Mechanical.Duct(mechanicalSystem=byName)
network = Orchid.RevitProject.Systems.Mechanical.Network(mechanicalSystem=byName)
connector_2 = Orchid.RevitProject.Systems.Element.Connector(element=network)

isPrimary = Orchid.RevitProject.Systems.Connector.IsPrimary(connector=code_block_2)
watch_5 = Watch(isPrimary)
vector = Orchid.RevitProject.Systems.Connector.Vector(connector=code_block_2)
watch_6 = Watch(vector)
shape = Orchid.RevitProject.Systems.Connector.Shape(connector=code_block_2)
watch_7 = Watch(shape.Shape)
watch_8 = Watch(shape.Dimension)
location = Orchid.RevitProject.Systems.Connector.Location(connector=code_block_2)
watch_9 = Watch(location)
direction = Orchid.RevitProject.Systems.Connector.Direction(connector=code_block_2)
watch_10 = Watch(direction)
mep_systems = MEPSystem("VI 1")  # graph input
