# Dynamo graph Connector_Piping.dyn (Dynamo 2.3.0.5885)
# packages: Orchid 203.2.0.7790

code_block = CodeBlock { "Cooling Supply"; }
byName = Orchid.RevitProject.Systems.MEPSystem.ByName(name=code_block)

# group: Component
equipment = Orchid.RevitProject.Systems.Piping.Equipment(pipingSystem=byName)
connector = Orchid.RevitProject.Systems.FamilyInstance.Connector(familyInstance=equipment)
component = Orchid.RevitProject.Systems.Piping.Component(pipingSystem=byName)
accessory = Orchid.RevitProject.Systems.Piping.Accessory(pipingSystem=byName)
fitting = Orchid.RevitProject.Systems.Piping.Fitting(pipingSystem=byName)

watch = Watch(connector)
code_block_2 = CodeBlock(data=connector) { data; }
connection = Orchid.RevitProject.Systems.Connector.Connection(connector=code_block_2)
watch_2 = Watch(connection)
isConnected = Orchid.RevitProject.Systems.Connector.IsConnected(connector=code_block_2)
watch_3 = Watch(isConnected)
host = Orchid.RevitProject.Systems.Connector.Host(connector=code_block_2)
watch_4 = Watch(host)

# group: Network
pipe = Orchid.RevitProject.Systems.Piping.Pipe(pipingSystem=byName)
connector_2 = Orchid.RevitProject.Systems.Element.Connector(element=pipe)
network = Orchid.RevitProject.Systems.Piping.Network(pipingSystem=byName)

mep_systems = MEPSystem("Cooling Supply")  # graph input
isPrimary = Orchid.RevitProject.Systems.Connector.IsPrimary(connector=code_block_2)
watch_5 = Watch(isPrimary)
vector = Orchid.RevitProject.Systems.Connector.Vector(connector=code_block_2)
watch_6 = Watch(vector)
shape = Orchid.RevitProject.Systems.Connector.Shape(connector=code_block_2)
watch_7 = Watch(shape.Shape)
watch_8 = Watch(shape.Dimension)
location = Orchid.RevitProject.Systems.Connector.Location(connector=code_block_2)
watch_9 = Watch(location)
direction = Orchid.RevitProject.Systems.Connector.Direction(connector=code_block_2)
watch_10 = Watch(direction)
