# Dynamo graph Mechanical.dyn (Dynamo 2.3.0.5885)
# packages: Orchid 203.2.0.7790

# group: Filter System by type
all = Orchid.RevitProject.Systems.MEPSystem.All()
# note: Dropdown value:
# MechanicalSystem
element_types = ElementTypes("MechanicalSystem")  # graph input
typeOf = Orchid.RevitProject.Elements.Element.TypeOf(element=all, type=element_types)
name = Element.Name(element=typeOf)
byName = Orchid.RevitProject.Systems.MEPSystem.ByName(name=name)
watch = Watch(name)
watch_2 = Watch(typeOf)
code_block = CodeBlock(system=typeOf) { system; system[0]; }
type = Orchid.RevitProject.Systems.MEPSystem.Type(system=typeOf)
watch_3 = Watch(type)

# group: MEP
mep_system_class = MEPSystemClass("CableTrayConduit")  # graph input
mep_system_types = MEPSystemType("57-Udsugning")  # graph input
duct_system_type = DuctSystemType("ExhaustAir")  # graph input
mep_systems = MEPSystem("VI 1")  # graph input

# group: Filter SystemType by type
all_2 = Orchid.RevitProject.Systems.MEPSystemType.All()
# note: Dropdown value:
# MechanicalSystemType
element_types_2 = ElementTypes("MechanicalSystemType")  # graph input
typeOf_2 = Orchid.RevitProject.Elements.Element.TypeOf(element=all_2, type=element_types_2)
name_2 = Element.Name(element=typeOf_2)
byName_2 = Orchid.RevitProject.Systems.MEPSystemType.ByName(name=name_2)
watch_4 = Watch(typeOf_2)
watch_5 = Watch(name_2)

create = Orchid.RevitProject.Systems.Mechanical.Create()  # unwired: baseConnector, connectors, type

# group: Calculation point
categories = Categories("OST_DuctTerminal")  # graph input
all_elements_of_category = ElementsOfCategory(Category=categories)
getFromToCalculationPoints = Orchid.RevitProject.Elements.FamilyInstance.GetFromToCalculationPoints(familyInstance=all_elements_of_category)  # frozen
getSpatialCalculationPoint = Orchid.RevitProject.Elements.FamilyInstance.GetSpatialCalculationPoint(familyInstance=all_elements_of_category)
hasFromToCalculationPoints = Orchid.RevitProject.Elements.FamilyInstance.HasFromToCalculationPoints(familyInstance=all_elements_of_category)  # frozen
hasSpatialCalculationPoint = Orchid.RevitProject.Elements.FamilyInstance.HasSpatialCalculationPoint(familyInstance=all_elements_of_category)
# note: Dropdown value:
# Air Terminals
families = Family("PCA MBB")  # graph input
code_block_2 = CodeBlock { "LCA MBB"; "PCA MBB"; }
byName_3 = Family.ByName(name=code_block_2.out1)
hasSpatialCalculationPoint_2 = Orchid.RevitProject.Elements.Family.HasSpatialCalculationPoint(family=byName_3)

boolean = BoolSelector(false)
component = Orchid.RevitProject.Systems.Mechanical.Component(mechanicalSystem=code_block.out1, include=boolean)
connector = Orchid.RevitProject.Systems.FamilyInstance.Connector(familyInstance=component)
watch_6 = Watch(connector)

# group: Duplicate
code_block_3 = CodeBlock { "test"; }
duplicate = Orchid.RevitProject.Systems.Mechanical.Duplicate(mechanicalSystem=code_block.out1, systemName=code_block_3)  # frozen
watch_7 = Watch(duplicate)

mep_systems_2 = MEPSystem("VI 1")  # graph input
code_block_4 = CodeBlock(system=mep_systems_2) { system; }
boolean_2 = BoolSelector(true)

# group: Component
component_2 = Orchid.RevitProject.Systems.Mechanical.Component(mechanicalSystem=code_block_4, include=boolean_2)
watch_8 = Watch(component_2)
fitting = Orchid.RevitProject.Systems.Mechanical.Fitting(mechanicalSystem=code_block_4)
watch_9 = Watch(fitting)
accessory = Orchid.RevitProject.Systems.Mechanical.Accessory(mechanicalSystem=code_block_4)
watch_10 = Watch(accessory)
terminal = Orchid.RevitProject.Systems.Mechanical.Terminal(mechanicalSystem=code_block_4)
watch_11 = Watch(terminal)
equipment = Orchid.RevitProject.Systems.Mechanical.Equipment(mechanicalSystem=code_block_4)
watch_12 = Watch(equipment)
handlingUnit = Orchid.RevitProject.Systems.Mechanical.HandlingUnit(mechanicalSystem=code_block_4)
watch_13 = Watch(handlingUnit)

handlingUnit_2 = Orchid.RevitProject.Systems.Mechanical.HandlingUnit(mechanicalSystem=code_block.out1)

# group: System
MEPSystem = Orchid.RevitProject.Systems.Connector.MEPSystem(connector=connector)
watch_14 = Watch(MEPSystem.System)
MEPSystem_2 = Orchid.RevitProject.Systems.FamilyInstance.MEPSystem(familyInstance=component)
watch_15 = Watch(MEPSystem_2.System)
MEPSystem_3 = Orchid.RevitProject.Systems.Element.MEPSystem(element=handlingUnit_2)
watch_16 = Watch(MEPSystem_3.System)
watch_17 = Watch(MEPSystem_3.Classification)
watch_18 = Watch(MEPSystem_2.Classification)
watch_19 = Watch(MEPSystem.Type)

# group: SystemType
MEPSystemType = Orchid.RevitProject.Systems.Connector.MEPSystemType(connector=connector)
watch_20 = Watch(MEPSystemType)
MEPSystemType_2 = Orchid.RevitProject.Systems.FamilyInstance.MEPSystemType(familyInstance=component)
watch_21 = Watch(MEPSystemType_2)
MEPSystemType_3 = Orchid.RevitProject.Systems.Element.MEPSystemType(element=handlingUnit_2)
watch_22 = Watch(MEPSystemType_3)

watch_23 = Watch(component)
watch_24 = Watch(mep_systems)
name_3 = Element.Name(element=mep_systems)
watch_25 = Watch(name_3)

# group: Network
duct = Orchid.RevitProject.Systems.Mechanical.Duct(mechanicalSystem=code_block_4)
watch_26 = Watch(duct)
network = Orchid.RevitProject.Systems.Mechanical.Network(mechanicalSystem=code_block_4)
watch_27 = Watch(network)
